# Dynamo graph script.dyn (Dynamo 2.3.2.15696)
# packages: Data-Shapes 2021.2.94

code_block = CodeBlock { "Etiquetas Linea de Fierro"; }
code_block_2 = CodeBlock { "INICIAR"; "CANCELAR"; 430; 140; }
code_block_3 = CodeBlock { "Seleccionar Etiquetas"; }
code_block_4 = CodeBlock { "SELECCIONAR"; }
categories = Categories("OST_DetailComponentTags")
selectmodelelements_data = Custom[SelectModelElements Data](InputName=code_block_3, ButtonText=code_block_4, CategoryFilter=categories)  # package Data-Shapes; Creates a Revit element selection input for UI.MultipleInputForm++ . Check out www.data-shapes.net for more infos!
code_block_5 = CodeBlock { true; }
multipleinputform = Custom[MultipleInputForm ++](Description_optional=code_block, ButtonText_optional=code_block_2.out0, Inputs=selectmodelelements_data, Toggle=code_block_5, CancelButtonText_optional=code_block_2.out1, Width_optional=code_block_2.out2, LabelWidth_optional=code_block_2.out3)  # package Data-Shapes; Create a form with multiple inputs. see www.data-shapes.net for tutorials and infos!
code_block_6 = CodeBlock(x=multipleinputform.User_Inputs) { x; }

# group: Pata Inferior
flatten = List.Flatten(list=code_block_6)
name = Element.Name(element=flatten)
groupByKey = List.GroupByKey(list=flatten, keys=name)
code_block_7 = CodeBlock { "Pata Inferior"; }
contains = String.Contains(str=groupByKey.unique_keys, searchFor=code_block_7)
filterByBoolMask = List.FilterByBoolMask(list=groupByKey.groups, mask=contains)
flatten_2 = List.Flatten(list=filterByBoolMask.in)
code_block_8 = CodeBlock { "Type"; }
family_types = FamilyTypes("EST_A_DETAIL ITEM TAG_LINEA DE FIERRO:Barra Vertical con Pata Inferior")
setParameterByName = Element.SetParameterByName(element=flatten_2, parameterName=code_block_8, value=family_types)

# group: Recta
flatten_3 = List.Flatten(list=code_block_6)
name_2 = Element.Name(element=flatten_3)
groupByKey_2 = List.GroupByKey(list=flatten_3, keys=name_2)
code_block_9 = CodeBlock { "Vertical Recta"; }
contains_2 = String.Contains(str=groupByKey_2.unique_keys, searchFor=code_block_9)
filterByBoolMask_2 = List.FilterByBoolMask(list=groupByKey_2.groups, mask=contains_2)
flatten_4 = List.Flatten(list=filterByBoolMask_2.in)
code_block_10 = CodeBlock { "Type"; }
family_types_2 = FamilyTypes("EST_A_DETAIL ITEM TAG_LINEA DE FIERRO:Barra Vertical Recta")
setParameterByName_2 = Element.SetParameterByName(element=flatten_4, parameterName=code_block_10, value=family_types_2)

# group: Pata Superior
flatten_5 = List.Flatten(list=code_block_6)
name_3 = Element.Name(element=flatten_5)
groupByKey_3 = List.GroupByKey(list=flatten_5, keys=name_3)
code_block_11 = CodeBlock { "Pata Superior"; }
contains_3 = String.Contains(str=groupByKey_3.unique_keys, searchFor=code_block_11)
filterByBoolMask_3 = List.FilterByBoolMask(list=groupByKey_3.groups, mask=contains_3)
flatten_6 = List.Flatten(list=filterByBoolMask_3.in)
code_block_12 = CodeBlock { "Type"; }
family_types_3 = FamilyTypes("EST_A_DETAIL ITEM TAG_LINEA DE FIERRO:Barra Vertical con Pata Superior")
setParameterByName_3 = Element.SetParameterByName(element=flatten_6, parameterName=code_block_12, value=family_types_3)
