# Dynamo graph DM_Final_script.dyn (Dynamo 2.6.2.15705)
# packages: Data-Shapes 2022.2.103, Structural Design 2021.1.22, Genius Loci 2021.11.10, Crumple 2022.2.13, archi-lab.net 2022.210.2419, Orchid 206.3.0.8161, Clockwork for Dynamo 2.x 2.4.0

byJoinedCurves = PolyCurve.ByJoinedCurves()  # unwired: curves
byJoinedCurves_2 = PolyCurve.ByJoinedCurves()  # unwired: curves
byJoinedCurves_3 = PolyCurve.ByJoinedCurves()  # unwired: curves
byLoft = Surface.ByLoft()  # unwired: crossSections
byJoinedCurves_4 = PolyCurve.ByJoinedCurves()  # unwired: curves
code_block = CodeBlock { "Doble Malla - Final"; }
file_path = Filename("..\..\..\..\..\..\..\..\..\..\Arainco\Arainco.png")
code_block_2 = CodeBlock { "INICIAR"; "CANCELAR"; true; 430; 170; 650; }
categories_ᶜᵒⁿᵛᵉʳᵗᵉᵈ_ᵈʳᵒᵖᵈᵒʷⁿ = CodeBlock { "Seleccionar Muro"; "SELECCIONAR"; t1 = "Walls"; category1 = Revit.Category.ByName(t1); }
selectmodelelements_data = Custom[SelectModelElements Data](InputName=categories_ᶜᵒⁿᵛᵉʳᵗᵉᵈ_ᵈʳᵒᵖᵈᵒʷⁿ.out0, ButtonText=categories_ᶜᵒⁿᵛᵉʳᵗᵉᵈ_ᵈʳᵒᵖᵈᵒʷⁿ.out1, CategoryFilter=categories_ᶜᵒⁿᵛᵉʳᵗᵉᵈ_ᵈʳᵒᵖᵈᵒʷⁿ.category1)  # package Data-Shapes; Creates a Revit element selection input for UI.MultipleInputForm++ . Check out www.data-shapes.net for more infos!
code_block_3 = CodeBlock { "Malla Vertical"; }
element_types_ᶜᵒⁿᵛᵉʳᵗᵉᵈ_ᵈʳᵒᵖᵈᵒʷⁿ = CodeBlock { DSCore.Types.FindTypeByNameInAssembly("RebarBarType", "RevitAPI"); }
all_elements_of_type = ElementsOfType(element_type=element_types_ᶜᵒⁿᵛᵉʳᵗᵉᵈ_ᵈʳᵒᵖᵈᵒʷⁿ)
code_block_4 = CodeBlock(elem_type=all_elements_of_type) { elem_type; elem_type_diameter = Properties.RebarDiameter(elem_type); }
sortByKey = List.SortByKey(list=code_block_4.elem_type, keys=code_block_4.elem_type_diameter)
code_block_5 = CodeBlock(elem_sorted=sortByKey.sorted_list)
# ---------- code_block_5.designscript (12 lines) ----------
elem_name = Revit.Elements.Element.Name(elem_sorted);

//InputName
"Diametro";
//Keys
elem_name;
//Values
elem_sorted;
//DefaultValueIndex
0;
//Sorted_optional
false;
# ----------------------------------------
dropdown_data = Custom[DropDown Data](InputName=code_block_5.out1, Keys=code_block_5.out2, Values=code_block_5.out3, DefaultValueIndex=code_block_5.out4, Sorted_optional=code_block_5.out5)  # package Data-Shapes; Create data for DropDown input in UI.MultiInputForm ++ . Check out www.data-shapes.net for more infos.
code_block_6 = CodeBlock { "Distanciamiento"; "200"; true; }
textbox_data = Custom[TextBox Data](InputName=code_block_6.out0, DefaultText=code_block_6.out1, IsNumberEntry=code_block_6.out2)  # package Data-Shapes; Create Data for TextBox input in UI.MultipleInputForm ++ . Check out www.data-shapes.net for more informations
list_create = List.Create(item0=dropdown_data, item1=textbox_data)
inputgroup_data = Custom[InputGroup Data](GroupTitle=code_block_3, Inputs=list_create)  # package Data-Shapes; Creates a group of inputs for UI.MultipleInputForm ++ . Check out www.data-shapes.net for more infos !
code_block_7 = CodeBlock { "Malla Horizontal"; }
element_types_ᶜᵒⁿᵛᵉʳᵗᵉᵈ_ᵈʳᵒᵖᵈᵒʷⁿ_2 = CodeBlock { DSCore.Types.FindTypeByNameInAssembly("RebarBarType", "RevitAPI"); }
all_elements_of_type_2 = ElementsOfType(element_type=element_types_ᶜᵒⁿᵛᵉʳᵗᵉᵈ_ᵈʳᵒᵖᵈᵒʷⁿ_2)
code_block_8 = CodeBlock(elem_type=all_elements_of_type_2) { elem_type; elem_type_diameter = Properties.RebarDiameter(elem_type); }
sortByKey_2 = List.SortByKey(list=code_block_8.elem_type, keys=code_block_8.elem_type_diameter)
code_block_9 = CodeBlock(elem_sorted=sortByKey_2.sorted_list)  # same code as code_block_5
dropdown_data_2 = Custom[DropDown Data](InputName=code_block_9.out1, Keys=code_block_9.out2, Values=code_block_9.out3, DefaultValueIndex=code_block_9.out4, Sorted_optional=code_block_9.out5)
code_block_10 = CodeBlock { "Distanciamiento"; "200"; true; }
textbox_data_2 = Custom[TextBox Data](InputName=code_block_10.out0, DefaultText=code_block_10.out1, IsNumberEntry=code_block_10.out2)
list_create_2 = List.Create(item0=dropdown_data_2, item1=textbox_data_2)
inputgroup_data_2 = Custom[InputGroup Data](GroupTitle=code_block_7, Inputs=list_create_2)
list_create_3 = List.Create(item0=selectmodelelements_data, item1=inputgroup_data, item2=inputgroup_data_2)
multipleinputform = Custom[MultipleInputForm ++](Description_optional=code_block, Logo_optional=file_path, ButtonText_optional=code_block_2.out0, Inputs=list_create_3, Toggle=code_block_2.out2, CancelButtonText_optional=code_block_2.out1, MaxHeight_optional=code_block_2.out5, Width_optional=code_block_2.out3, LabelWidth_optional=code_block_2.out4)  # package Data-Shapes; Create a form with multiple inputs. see www.data-shapes.net for tutorials and infos!
code_block_11 = CodeBlock(l=multipleinputform.User_Inputs)
# ---------- code_block_11.designscript (12 lines) ----------
l;
[Imperative]
{
	if (l == null)
	{
		return = [[],[],[],[],[],[]];
	}
	else
	{
		return = l;
	}
};
# ----------------------------------------
code_block_12 = CodeBlock(x=code_block_11.out1) { x; }
code_block_13 = CodeBlock(malla_vertical=code_block_12) { malla_vertical[0]; malla_vertical[1]; malla_vertical[2]; malla_vertical[3]; }
code_block_14 = CodeBlock(x=code_block_13.out0) { x; }
code_block_15 = CodeBlock(x=code_block_14) { x; }
getCategory = Element.GetCategory(element=code_block_15)
string_from_object = FromObject(obj=getCategory)
code_block_16 = CodeBlock { "Walls"; }
eq = string_from_object == code_block_16
filterByBoolMask = List.FilterByBoolMask(list=code_block_15, mask=eq)
geometry = Element.Geometry(element=filterByBoolMask.in)
flatten = List.Flatten(list=geometry)
getLocation = Element.GetLocation(element=filterByBoolMask.in)
code_block_17 = CodeBlock { 0.5; }
planeAtParameter = Curve.PlaneAtParameter(curve=getLocation, param=code_block_17)
intersect = Geometry.Intersect(geometry=flatten, other=planeAtParameter)
perimeterCurves = Surface.PerimeterCurves(surface=intersect)
flatten_2 = List.Flatten(list=perimeterCurves)
function_apply = ApplyFunction(func=byJoinedCurves_4, arg1=flatten_2)
curves = PolyCurve.Curves(polyCurve=function_apply)
code_block_18 = CodeBlock { [0,2]; }
getItemAtIndex = List.GetItemAtIndex(list=curves@L2, index=code_block_18)
code_block_19 = CodeBlock { 8000; }
extendStart = Curve.ExtendStart(curve=getItemAtIndex, distance=code_block_19)
extendEnd = Curve.ExtendEnd(curve=extendStart, distance=code_block_19)
function_apply_2 = ApplyFunction(func=byLoft, arg1=extendEnd)
byUnion = Solid.ByUnion()  # unwired: solids
code_block_20 = CodeBlock(x=code_block_14) { x; }
geometry_2 = Element.Geometry(element=code_block_20)
flatten_3 = List.Flatten(list=geometry_2)
function_apply_3 = ApplyFunction(func=byUnion, arg1=flatten_3)
intersect_2 = Geometry.Intersect(geometry=function_apply_2, other=function_apply_3)
flatten_4 = List.Flatten(list=intersect_2)
elementcentroid = Custom[© ElementCentroid](element=filterByBoolMask.in)  # package Crumple; Returns the centroid of the element's axis-aligned bounding box.
normalAtPoint = Surface.NormalAtPoint(surface=flatten_4, point=elementcentroid)
code_block_21 = CodeBlock(x=code_block_14) { x; }
code_block_22 = CodeBlock { "Length"; }
getParameterValueByName = Element.GetParameterValueByName(element=code_block_21, parameterName=code_block_22)
round = Math.Round(number=getParameterValueByName)
code_block_23 = CodeBlock(t2=round) { t1 = t2 / 2; t3 = t1 - 200; t4 = t3 * -1; }
translate = Geometry.Translate(geometry=flatten_4, direction=normalAtPoint, distance=code_block_23.t4)
perimeterCurves_2 = Surface.PerimeterCurves(surface=translate)
function_apply_4 = ApplyFunction(func=byJoinedCurves_3, arg1=perimeterCurves_2)
code_block_24 = CodeBlock { -20; false; }
offset = PolyCurve.Offset(polyCurve=function_apply_4, signedDistance=code_block_24.out0, extendCircular=code_block_24.out1)
function_apply_5 = ApplyFunction(func=byJoinedCurves_2, arg1=offset)
curves_2 = PolyCurve.Curves(polyCurve=function_apply_5)
version = Custom[Application.Version]()  # package Clockwork for Dynamo 2.x; Retrieves the name, version and build of the current Revit application.
python_script = Python(IN[0]=version.Version)
# ---------- python_script.python (8 lines) ----------
input = IN[0]

if input == 2024:
    res = [3, 2]
else:
    res = [0, 1]

OUT = res
# ----------------------------------------
getItemAtIndex_2 = List.GetItemAtIndex(list=curves_2@L2, index=python_script)
function_apply_6 = ApplyFunction(func=byJoinedCurves, arg1=getItemAtIndex_2)
curves_3 = PolyCurve.Curves(polyCurve=function_apply_6)
code_block_25 = CodeBlock { 1; }
shiftIndices = List.ShiftIndices(list=curves_3, amount=code_block_25)
byJoinedCurves_5 = PolyCurve.ByJoinedCurves()  # unwired: curves
byJoinedCurves_6 = PolyCurve.ByJoinedCurves()  # unwired: curves
byJoinedCurves_7 = PolyCurve.ByJoinedCurves()  # unwired: curves
byLoft_2 = Surface.ByLoft()  # unwired: crossSections
byJoinedCurves_8 = PolyCurve.ByJoinedCurves()  # unwired: curves
code_block_26 = CodeBlock(malla_vertical=code_block_12) { malla_vertical[0]; malla_vertical[1]; malla_vertical[2]; malla_vertical[3]; }
code_block_27 = CodeBlock(x=code_block_26.out0) { x; }
code_block_28 = CodeBlock(x=code_block_27) { x; }
getCategory_2 = Element.GetCategory(element=code_block_28)
string_from_object_2 = FromObject(obj=getCategory_2)
code_block_29 = CodeBlock { "Walls"; }
eq_2 = string_from_object_2 == code_block_29
filterByBoolMask_2 = List.FilterByBoolMask(list=code_block_28, mask=eq_2)
geometry_3 = Element.Geometry(element=filterByBoolMask_2.in)
flatten_5 = List.Flatten(list=geometry_3)
getLocation_2 = Element.GetLocation(element=filterByBoolMask_2.in)
code_block_30 = CodeBlock { 0.5; }
planeAtParameter_2 = Curve.PlaneAtParameter(curve=getLocation_2, param=code_block_30)
intersect_3 = Geometry.Intersect(geometry=flatten_5, other=planeAtParameter_2)
perimeterCurves_3 = Surface.PerimeterCurves(surface=intersect_3)
flatten_6 = List.Flatten(list=perimeterCurves_3)
function_apply_7 = ApplyFunction(func=byJoinedCurves_8, arg1=flatten_6)
curves_4 = PolyCurve.Curves(polyCurve=function_apply_7)
code_block_31 = CodeBlock { [0,2]; }
getItemAtIndex_3 = List.GetItemAtIndex(list=curves_4@L2, index=code_block_31)
code_block_32 = CodeBlock { 8000; }
extendStart_2 = Curve.ExtendStart(curve=getItemAtIndex_3, distance=code_block_32)
extendEnd_2 = Curve.ExtendEnd(curve=extendStart_2, distance=code_block_32)
function_apply_8 = ApplyFunction(func=byLoft_2, arg1=extendEnd_2)
byUnion_2 = Solid.ByUnion()  # unwired: solids
code_block_33 = CodeBlock(x=code_block_27) { x; }
geometry_4 = Element.Geometry(element=code_block_33)
flatten_7 = List.Flatten(list=geometry_4)
function_apply_9 = ApplyFunction(func=byUnion_2, arg1=flatten_7)
intersect_4 = Geometry.Intersect(geometry=function_apply_8, other=function_apply_9)
flatten_8 = List.Flatten(list=intersect_4)
elementcentroid_2 = Custom[© ElementCentroid](element=filterByBoolMask_2.in)
normalAtPoint_2 = Surface.NormalAtPoint(surface=flatten_8, point=elementcentroid_2)
code_block_34 = CodeBlock(x=code_block_27) { x; }
code_block_35 = CodeBlock { "Length"; }
getParameterValueByName_2 = Element.GetParameterValueByName(element=code_block_34, parameterName=code_block_35)
round_2 = Math.Round(number=getParameterValueByName_2)
rebarDiameter = StructuralDesign.Rebar.Properties.RebarDiameter(rebar=code_block_26.out1)
code_block_36 = CodeBlock(t2=round_2, barDiameter=rebarDiameter) { t1 = t2 / 2; t3 = t1 - 200; t4 = t3 * -1 + barDiameter; }
translate_2 = Geometry.Translate(geometry=flatten_8, direction=normalAtPoint_2, distance=code_block_36.t4)
perimeterCurves_4 = Surface.PerimeterCurves(surface=translate_2)
function_apply_10 = ApplyFunction(func=byJoinedCurves_7, arg1=perimeterCurves_4)
code_block_37 = CodeBlock { -20; false; }
offset_2 = PolyCurve.Offset(polyCurve=function_apply_10, signedDistance=code_block_37.out0, extendCircular=code_block_37.out1)
function_apply_11 = ApplyFunction(func=byJoinedCurves_6, arg1=offset_2)
curves_5 = PolyCurve.Curves(polyCurve=function_apply_11)
version_2 = Custom[Application.Version]()
python_script_2 = Python(IN[0]=version_2.Version)
# ---------- python_script_2.python (8 lines) ----------
input = IN[0]

if input == 2024:
    res = [3, 0]
else:
    res = [0, 3]

OUT = res
# ----------------------------------------
getItemAtIndex_4 = List.GetItemAtIndex(list=curves_5@L2, index=python_script_2)
function_apply_12 = ApplyFunction(func=byJoinedCurves_5, arg1=getItemAtIndex_4)
curves_6 = PolyCurve.Curves(polyCurve=function_apply_12)
code_block_38 = CodeBlock { 1; }
shiftIndices_2 = List.ShiftIndices(list=curves_6, amount=code_block_38)
code_block_39 = CodeBlock(x=code_block_11.out1) { x; }
code_block_40 = CodeBlock(x=code_block_39) { coleccion = x[0]; categorias = Revit.Elements.Element.GetCategory(coleccion); }
string_from_object_3 = FromObject(obj=code_block_40.categorias)
datos_mallas_para_etiqueta = CodeBlock(x=code_block_39, categorias=string_from_object_3)
# ---------- datos_mallas_para_etiqueta.designscript (23 lines) ----------
coleccion = x[0];
mask = categorias == "Walls";
DSCore.List.FilterByBoolMask(coleccion, mask)["in"];




//Malla Vertical
muros_v = x[0];
bar_v = x[1];
dist_v = x[2];
diam_bar_v = Properties.RebarDiameter(bar_v);
malla_v = "ø"+DSCore.Math.Ceiling(diam_bar_v)+"@"+DSCore.Math.Ceiling(dist_v);
Elements.View3D.SetParameterByName(muros_v<1L>, "Vertical", malla_v);


//Malla Horizontal
muros_h = x[0];
bar_h = x[3];
dist_h = x[4];
diam_bar_h = Properties.RebarDiameter(bar_h);
malla_h = "ø"+DSCore.Math.Ceiling(diam_bar_h)+"@"+DSCore.Math.Ceiling(dist_h);
Elements.View3D.SetParameterByName(muros_h<1L>, "Horizontal", malla_h);
# ----------------------------------------
o_document_activeview = Orchid.RevitProject.Common.Document.ActiveView()
byJoinedCurves_9 = PolyCurve.ByJoinedCurves()  # unwired: curves
intersect_5 = Geometry.Intersect()  # unwired: geometry, other
byLoft_3 = Surface.ByLoft()  # unwired: crossSections
code_block_41 = CodeBlock(x=code_block_11.out1) { x; }
code_block_42 = CodeBlock(malla_horizontal=code_block_41) { malla_horizontal[0]; malla_horizontal[3]; malla_horizontal[4]; }
code_block_43 = CodeBlock(x=code_block_42.out0) { x; }
getCategory_3 = Element.GetCategory(element=code_block_43)
string_from_object_4 = FromObject(obj=getCategory_3)
code_block_44 = CodeBlock { "Walls"; }
eq_3 = string_from_object_4 == code_block_44
filterByBoolMask_3 = List.FilterByBoolMask(list=code_block_43, mask=eq_3)
geometry_5 = Element.Geometry(element=filterByBoolMask_3.in)
flatten_9 = List.Flatten(list=geometry_5)
centroid = Solid.Centroid(solid=flatten_9)
byOriginNormal = Plane.ByOriginNormal(origin=centroid)
intersect_6 = Geometry.Intersect(geometry=flatten_9, other=byOriginNormal)
flatten_10 = List.Flatten(list=intersect_6)
perimeterCurves_5 = Surface.PerimeterCurves(surface=flatten_10)
code_block_45 = CodeBlock { [1,3]; }
getItemAtIndex_5 = List.GetItemAtIndex(list=perimeterCurves_5@L2, index=code_block_45)
list_clean = Custom[List Clean](list=getItemAtIndex_5)  # package Genius Loci; Removes all Null, Empty and Blank from a list or nested list of lists.
code_block_46 = CodeBlock { 1000; }
extendEnd_3 = Curve.ExtendEnd(curve=list_clean, distance=code_block_46)
extendStart_3 = Curve.ExtendStart(curve=extendEnd_3, distance=code_block_46)
function_apply_13 = ApplyFunction(func=byLoft_3, arg1=extendStart_3)
byUnion_3 = Solid.ByUnion()  # unwired: solids
geometry_6 = Element.Geometry()  # unwired: element
filterByBoolMask_4 = List.FilterByBoolMask()  # unwired: list, mask
get_joined_elements = Custom[Get Joined Elements](element=filterByBoolMask_3.in@L1)  # package Genius Loci; Returns all elements joined to the given element.
getCategory_4 = Element.GetCategory()  # unwired: element
function_apply_14 = ApplyFunction(func=getCategory_4, arg1=get_joined_elements)
string_from_object_5 = FromObject(obj=function_apply_14)
code_block_47 = CodeBlock { "Walls"; }
eq_4 = string_from_object_5 == code_block_47
function_apply_15 = ApplyFunction(func=filterByBoolMask_4.in, arg1=get_joined_elements, arg2=eq_4)
code_block_48 = CodeBlock(x=function_apply_15)
# ---------- code_block_48.designscript (13 lines) ----------
x;

[Imperative]
{
	if (x == null)
	{
		return = [];
	}
	else
	{
		return = x;
	}
};
# ----------------------------------------
count = List.Count(list=filterByBoolMask_3.in)
ofRepeatedItem = List.OfRepeatedItem(item=code_block_48.out1, amount=count)
addItemToFront = List.AddItemToFront(item=filterByBoolMask_3.in@L1, list=ofRepeatedItem@L2)
function_apply_16 = ApplyFunction(func=geometry_6, arg1=addItemToFront)
list_clean_2 = Custom[List Clean](list=function_apply_16)
flatten_11 = List.Flatten(list=list_clean_2@L3)
function_apply_17 = ApplyFunction(func=byUnion_3, arg1=flatten_11)
function_apply_18 = ApplyFunction(func=intersect_5, arg1=function_apply_13, arg2=function_apply_17)
flatten_12 = List.Flatten(list=function_apply_18)
version_3 = Custom[Application.Version]()
normalAtPoint_3 = Surface.NormalAtPoint(surface=flatten_12, point=centroid)
reverse = Vector.Reverse(vector=normalAtPoint_3)
python_script_3 = Python(IN[0]=version_3.Version, IN[1]=normalAtPoint_3, IN[2]=reverse)
# ---------- python_script_3.python (10 lines) ----------
input = IN[0]
vector = IN[1]
vector_reverse = IN[2]

if input == 2024:
    res = vector_reverse
else:
    res = vector

OUT = res
# ----------------------------------------
code_block_49 = CodeBlock { "Unconnected Height"; }
getParameterValueByName_3 = Element.GetParameterValueByName(element=filterByBoolMask_3.in, parameterName=code_block_49)
code_block_50 = CodeBlock(t2=getParameterValueByName_3) { t1 = t2 / 2; t3 = t1 - 100; t4 = t3 * -1; }
translate_3 = Geometry.Translate(geometry=flatten_12, direction=python_script_3, distance=code_block_50.t4)
perimeterCurves_6 = Surface.PerimeterCurves(surface=translate_3)
function_apply_19 = ApplyFunction(func=byJoinedCurves_9, arg1=perimeterCurves_6)
code_block_51 = CodeBlock { -20; }
offset_3 = Curve.Offset(curve=function_apply_19, distance=code_block_51)
byJoinedCurves_10 = PolyCurve.ByJoinedCurves(curves=offset_3@L1)
curves_7 = PolyCurve.Curves(polyCurve=byJoinedCurves_10)
code_block_52 = CodeBlock(x=curves_7)
# ---------- code_block_52.designscript (13 lines) ----------
x;

[Imperative]
{
	if (x == null)
	{
		return = [null,null,null,null];
	}
	else
	{
		return = x;
	}
};
# ----------------------------------------
code_block_53 = CodeBlock { [0,1]; }
getItemAtIndex_6 = List.GetItemAtIndex(list=code_block_52.out1@L2, index=code_block_53)
element_types_ᶜᵒⁿᵛᵉʳᵗᵉᵈ_ᵈʳᵒᵖᵈᵒʷⁿ_3 = CodeBlock { DSCore.Types.FindTypeByNameInAssembly("RebarHookType", "RevitAPI"); }
all_elements_of_type_3 = ElementsOfType(element_type=element_types_ᶜᵒⁿᵛᵉʳᵗᵉᵈ_ᵈʳᵒᵖᵈᵒʷⁿ_3)
rebar_hook_type_at_start = CodeBlock(t3=all_elements_of_type_3)
# ---------- rebar_hook_type_at_start.designscript (6 lines) ----------
t1 = t3;
str2 = Revit.Elements.Element.Name(t1);
t2 = str2 == "Standard - 135 deg.";
t4 = DSCore.List.FilterByBoolMask(t3, t2);
t5 = Dictionary.ValueAtKey(t4, "in");
t6 = Dictionary.ValueAtKey(t4, "out");
# ----------------------------------------
code_block_54 = CodeBlock(RebarHookType=rebar_hook_type_at_start.t5, rebar_bar_type=code_block_42.out1)
# ---------- code_block_54.designscript (8 lines) ----------
//RebaarStyle
"Standard";
//RebarHookOrientation
"Right";
//Rebar Hook Type;
RebarHookType;
//RebarBarType
rebar_bar_type;
# ----------------------------------------
fromCurves = StructuralDesign.Rebar.Create.FromCurves(curves=getItemAtIndex_6@L2, rebarStyle=code_block_54.out0@L1, rebarBarType=code_block_54.rebar_bar_type@L1, startHookType=code_block_54.RebarHookType@L1, endHookType=code_block_54.RebarHookType@L1, startHookOrientation=code_block_54.out1@L1, endHookOrientation=code_block_54.out1@L1, hostElement=filterByBoolMask_3.in@L1, vector=python_script_3@L1, lacing=Longest)
distanciamiento_barras = CodeBlock(distanciamiento_barras=code_block_42.out2) { distanciamiento_barras; }
code_block_55 = CodeBlock { 350; }
sub = getParameterValueByName_3 - code_block_55
setLayoutAsMaximumSpacing = StructuralDesign.Rebar.Layout.SetLayoutAsMaximumSpacing(rebar=fromCurves, spacing=distanciamiento_barras, arrayLength=sub)
hideElements = archilab.Revit.Views.Views.HideElements(view=o_document_activeview, elements=setLayoutAsMaximumSpacing)
o_document_activeview_2 = Orchid.RevitProject.Common.Document.ActiveView()
byJoinedCurves_11 = PolyCurve.ByJoinedCurves()  # unwired: curves
intersect_7 = Geometry.Intersect()  # unwired: geometry, other
byLoft_4 = Surface.ByLoft()  # unwired: crossSections
code_block_56 = CodeBlock(malla_horizontal=code_block_41) { malla_horizontal[0]; malla_horizontal[3]; malla_horizontal[4]; }
code_block_57 = CodeBlock(x=code_block_56.out0) { x; }
getCategory_5 = Element.GetCategory(element=code_block_57)
string_from_object_6 = FromObject(obj=getCategory_5)
code_block_58 = CodeBlock { "Walls"; }
eq_5 = string_from_object_6 == code_block_58
filterByBoolMask_5 = List.FilterByBoolMask(list=code_block_57, mask=eq_5)
geometry_7 = Element.Geometry(element=filterByBoolMask_5.in)
flatten_13 = List.Flatten(list=geometry_7)
centroid_2 = Solid.Centroid(solid=flatten_13)
byOriginNormal_2 = Plane.ByOriginNormal(origin=centroid_2)
intersect_8 = Geometry.Intersect(geometry=flatten_13, other=byOriginNormal_2)
flatten_14 = List.Flatten(list=intersect_8)
perimeterCurves_7 = Surface.PerimeterCurves(surface=flatten_14)
code_block_59 = CodeBlock(x=perimeterCurves_7)  # same code as code_block_52
code_block_60 = CodeBlock { [1,3]; }
getItemAtIndex_7 = List.GetItemAtIndex(list=code_block_59.out1@L2, index=code_block_60)
list_clean_3 = Custom[List Clean](list=getItemAtIndex_7)
code_block_61 = CodeBlock { 1000; }
extendEnd_4 = Curve.ExtendEnd(curve=list_clean_3, distance=code_block_61)
extendStart_4 = Curve.ExtendStart(curve=extendEnd_4, distance=code_block_61)
function_apply_20 = ApplyFunction(func=byLoft_4, arg1=extendStart_4)
byUnion_4 = Solid.ByUnion()  # unwired: solids
geometry_8 = Element.Geometry()  # unwired: element
filterByBoolMask_6 = List.FilterByBoolMask()  # unwired: list, mask
get_joined_elements_2 = Custom[Get Joined Elements](element=filterByBoolMask_5.in@L1)
getCategory_6 = Element.GetCategory()  # unwired: element
function_apply_21 = ApplyFunction(func=getCategory_6, arg1=get_joined_elements_2)
string_from_object_7 = FromObject(obj=function_apply_21)
code_block_62 = CodeBlock { "Walls"; }
eq_6 = string_from_object_7 == code_block_62
function_apply_22 = ApplyFunction(func=filterByBoolMask_6.in, arg1=get_joined_elements_2, arg2=eq_6)
code_block_63 = CodeBlock(x=function_apply_22)  # same code as code_block_48
count_2 = List.Count(list=filterByBoolMask_5.in)
ofRepeatedItem_2 = List.OfRepeatedItem(item=code_block_63.out1, amount=count_2)
addItemToFront_2 = List.AddItemToFront(item=filterByBoolMask_5.in@L1, list=ofRepeatedItem_2@L2)
function_apply_23 = ApplyFunction(func=geometry_8, arg1=addItemToFront_2)
list_clean_4 = Custom[List Clean](list=function_apply_23)
flatten_15 = List.Flatten(list=list_clean_4@L3)
function_apply_24 = ApplyFunction(func=byUnion_4, arg1=flatten_15)
function_apply_25 = ApplyFunction(func=intersect_7, arg1=function_apply_20, arg2=function_apply_24)
flatten_16 = List.Flatten(list=function_apply_25)
version_4 = Custom[Application.Version]()
normalAtPoint_4 = Surface.NormalAtPoint(surface=flatten_16, point=centroid_2)
reverse_2 = Vector.Reverse(vector=normalAtPoint_4)
python_script_4 = Python(IN[0]=version_4.Version, IN[1]=normalAtPoint_4, IN[2]=reverse_2)  # same code as python_script_3
code_block_64 = CodeBlock { "Unconnected Height"; }
getParameterValueByName_4 = Element.GetParameterValueByName(element=filterByBoolMask_5.in, parameterName=code_block_64)
rebarDiameter_2 = StructuralDesign.Rebar.Properties.RebarDiameter(rebar=code_block_56.out1)
code_block_65 = CodeBlock(t5=getParameterValueByName_4, num1=rebarDiameter_2) { t2 = t5; t1 = t2 / 2; t3 = t1 - 100; t4 = t3 * -1; t6 = t4 + num1; }
translate_4 = Geometry.Translate(geometry=flatten_16, direction=python_script_4, distance=code_block_65.t6)
perimeterCurves_8 = Surface.PerimeterCurves(surface=translate_4)
function_apply_26 = ApplyFunction(func=byJoinedCurves_11, arg1=perimeterCurves_8)
code_block_66 = CodeBlock { -20; }
offset_4 = Curve.Offset(curve=function_apply_26, distance=code_block_66)
byJoinedCurves_12 = PolyCurve.ByJoinedCurves(curves=offset_4@L1)
curves_8 = PolyCurve.Curves(polyCurve=byJoinedCurves_12)
code_block_67 = CodeBlock { [2,3]; }
getItemAtIndex_8 = List.GetItemAtIndex(list=curves_8@L2, index=code_block_67)
element_types_ᶜᵒⁿᵛᵉʳᵗᵉᵈ_ᵈʳᵒᵖᵈᵒʷⁿ_4 = CodeBlock { DSCore.Types.FindTypeByNameInAssembly("RebarHookType", "RevitAPI"); }
all_elements_of_type_4 = ElementsOfType(element_type=element_types_ᶜᵒⁿᵛᵉʳᵗᵉᵈ_ᵈʳᵒᵖᵈᵒʷⁿ_4)
rebar_hook_type_at_start_2 = CodeBlock(t3=all_elements_of_type_4)  # same code as rebar_hook_type_at_start
code_block_68 = CodeBlock(RebarHookType=rebar_hook_type_at_start_2.t5, rebar_bar_type=code_block_56.out1)  # same code as code_block_54
fromCurves_2 = StructuralDesign.Rebar.Create.FromCurves(curves=getItemAtIndex_8@L2, rebarStyle=code_block_68.out0@L1, rebarBarType=code_block_68.rebar_bar_type@L1, startHookType=code_block_68.RebarHookType@L1, endHookType=code_block_68.RebarHookType@L1, startHookOrientation=code_block_68.out1@L1, endHookOrientation=code_block_68.out1@L1, hostElement=filterByBoolMask_5.in@L1, vector=python_script_4@L1, lacing=Longest)
distanciamiento_barras_2 = CodeBlock(distanciamiento_barras=code_block_56.out2) { distanciamiento_barras; }
code_block_69 = CodeBlock { 350; }
sub_2 = getParameterValueByName_4 - code_block_69
setLayoutAsMaximumSpacing_2 = StructuralDesign.Rebar.Layout.SetLayoutAsMaximumSpacing(rebar=fromCurves_2, spacing=distanciamiento_barras_2, arrayLength=sub_2)
hideElements_2 = archilab.Revit.Views.Views.HideElements(view=o_document_activeview_2, elements=setLayoutAsMaximumSpacing_2)
o_document_activeview_3 = Orchid.RevitProject.Common.Document.ActiveView()
byJoinedCurves_13 = PolyCurve.ByJoinedCurves()  # unwired: curves
reverse_3 = Curve.Reverse(curve=curves_3)
code_block_70 = CodeBlock { 1; }
code_block_71 = CodeBlock { 20; }
extendStart_5 = Curve.ExtendStart(curve=reverse_3, distance=code_block_71)
code_block_72 = CodeBlock { 1; }
getItemAtIndex_9 = List.GetItemAtIndex(list=extendStart_5@L2, index=code_block_72)
replaceItemAtIndex = List.ReplaceItemAtIndex(list=reverse_3@L2, index=code_block_70@L1, item=getItemAtIndex_9@L1)
function_apply_27 = ApplyFunction(func=byJoinedCurves_13, arg1=replaceItemAtIndex)
curves_9 = PolyCurve.Curves(polyCurve=function_apply_27)
code_block_73 = CodeBlock(rebar_bar_type=code_block_13.out1)
# ---------- code_block_73.designscript (8 lines) ----------
//RebaarStyle
"Standard";
//RebarHookOrientation
"Right";
//Rebar Hook Type;
null;
//RebarBarType
rebar_bar_type;
# ----------------------------------------
element_types_ᶜᵒⁿᵛᵉʳᵗᵉᵈ_ᵈʳᵒᵖᵈᵒʷⁿ_5 = CodeBlock { DSCore.Types.FindTypeByNameInAssembly("RebarHookType", "RevitAPI"); }
all_elements_of_type_5 = ElementsOfType(element_type=element_types_ᶜᵒⁿᵛᵉʳᵗᵉᵈ_ᵈʳᵒᵖᵈᵒʷⁿ_5)
rebar_hook_type_at_start_3 = CodeBlock(t3=all_elements_of_type_5)  # same code as rebar_hook_type_at_start
fromCurves_3 = StructuralDesign.Rebar.Create.FromCurves(curves=curves_9@L2, rebarStyle=code_block_73.out0@L1, rebarBarType=code_block_73.rebar_bar_type@L1, startHookType=rebar_hook_type_at_start_3.t5@L1, endHookType=code_block_73.out2@L1, startHookOrientation=code_block_73.out1@L1, endHookOrientation=code_block_73.out1@L1, hostElement=filterByBoolMask.in@L1, vector=normalAtPoint@L1, lacing=Longest)
distanciamiento_barras_3 = CodeBlock(distanciamiento_barras=code_block_13.out2) { distanciamiento_barras; }
code_block_74 = CodeBlock { 400; }
sub_3 = round - code_block_74
setLayoutAsMaximumSpacing_3 = StructuralDesign.Rebar.Layout.SetLayoutAsMaximumSpacing(rebar=fromCurves_3, spacing=distanciamiento_barras_3, arrayLength=sub_3)
hideElements_3 = archilab.Revit.Views.Views.HideElements(view=o_document_activeview_3, elements=setLayoutAsMaximumSpacing_3)
o_document_activeview_4 = Orchid.RevitProject.Common.Document.ActiveView()
byJoinedCurves_14 = PolyCurve.ByJoinedCurves()  # unwired: curves
reverse_4 = Curve.Reverse(curve=curves_6)
code_block_75 = CodeBlock { 1; }
code_block_76 = CodeBlock { 20; }
extendStart_6 = Curve.ExtendStart(curve=reverse_4, distance=code_block_76)
code_block_77 = CodeBlock { 1; }
getItemAtIndex_10 = List.GetItemAtIndex(list=extendStart_6@L2, index=code_block_77)
replaceItemAtIndex_2 = List.ReplaceItemAtIndex(list=reverse_4@L2, index=code_block_75@L1, item=getItemAtIndex_10@L1)
function_apply_28 = ApplyFunction(func=byJoinedCurves_14, arg1=replaceItemAtIndex_2)
curves_10 = PolyCurve.Curves(polyCurve=function_apply_28)
code_block_78 = CodeBlock(rebar_bar_type=code_block_26.out1)
# ---------- code_block_78.designscript (8 lines) ----------
//RebaarStyle
"Standard";
//RebarHookOrientation
"Left";
//Rebar Hook Type;
null;
//RebarBarType
rebar_bar_type;
# ----------------------------------------
element_types_ᶜᵒⁿᵛᵉʳᵗᵉᵈ_ᵈʳᵒᵖᵈᵒʷⁿ_6 = CodeBlock { DSCore.Types.FindTypeByNameInAssembly("RebarHookType", "RevitAPI"); }
all_elements_of_type_6 = ElementsOfType(element_type=element_types_ᶜᵒⁿᵛᵉʳᵗᵉᵈ_ᵈʳᵒᵖᵈᵒʷⁿ_6)
rebar_hook_type_at_start_4 = CodeBlock(t3=all_elements_of_type_6)  # same code as rebar_hook_type_at_start
fromCurves_4 = StructuralDesign.Rebar.Create.FromCurves(curves=curves_10@L2, rebarStyle=code_block_78.out0@L1, rebarBarType=code_block_78.rebar_bar_type@L1, startHookType=rebar_hook_type_at_start_4.t5@L1, endHookType=code_block_78.out2@L1, startHookOrientation=code_block_78.out1@L1, endHookOrientation=code_block_78.out1@L1, hostElement=filterByBoolMask_2.in@L1, vector=normalAtPoint_2@L1, lacing=Longest)
distanciamiento_barras_4 = CodeBlock(distanciamiento_barras=code_block_26.out2) { distanciamiento_barras; }
code_block_79 = CodeBlock { 400; }
sub_4 = round_2 - code_block_79
setLayoutAsMaximumSpacing_4 = StructuralDesign.Rebar.Layout.SetLayoutAsMaximumSpacing(rebar=fromCurves_4, spacing=distanciamiento_barras_4, arrayLength=sub_4)
hideElements_4 = archilab.Revit.Views.Views.HideElements(view=o_document_activeview_4, elements=setLayoutAsMaximumSpacing_4)
