# Dynamo graph DM_Intermedia_script.dyn (Dynamo 2.6.2.15705)
# packages: Structural Design 2021.1.22, Data-Shapes 2022.2.103, Genius Loci 2021.11.10, archi-lab.net 2022.210.2419, Clockwork for Dynamo 2.x 2.4.0

code_block = CodeBlock { 0; }
code_block_2 = CodeBlock { "Doble Malla - Intermedia"; }
file_path = Filename("..\..\..\..\..\..\..\..\..\..\Arainco\Arainco.png")
code_block_3 = CodeBlock { "INICIAR"; "CANCELAR"; true; 430; 170; 650; }
categories_ᶜᵒⁿᵛᵉʳᵗᵉᵈ_ᵈʳᵒᵖᵈᵒʷⁿ = CodeBlock { "Seleccionar Muros a Armar"; "SELECCIONAR"; Revit.Category.ByName("Walls"); }
selectmodelelements_data = Custom[SelectModelElements Data](InputName=categories_ᶜᵒⁿᵛᵉʳᵗᵉᵈ_ᵈʳᵒᵖᵈᵒʷⁿ.out0, ButtonText=categories_ᶜᵒⁿᵛᵉʳᵗᵉᵈ_ᵈʳᵒᵖᵈᵒʷⁿ.out1, CategoryFilter=categories_ᶜᵒⁿᵛᵉʳᵗᵉᵈ_ᵈʳᵒᵖᵈᵒʷⁿ.out2)  # package Data-Shapes; Creates a Revit element selection input for UI.MultipleInputForm++ . Check out www.data-shapes.net for more infos!
code_block_4 = CodeBlock { "Malla Vertical"; }
element_types_ᶜᵒⁿᵛᵉʳᵗᵉᵈ_ᵈʳᵒᵖᵈᵒʷⁿ = CodeBlock { DSCore.Types.FindTypeByNameInAssembly("RebarBarType", "RevitAPI"); }
all_elements_of_type = ElementsOfType(element_type=element_types_ᶜᵒⁿᵛᵉʳᵗᵉᵈ_ᵈʳᵒᵖᵈᵒʷⁿ)
code_block_5 = CodeBlock(elem_type=all_elements_of_type) { elem_type; elem_type_diameter = Properties.RebarDiameter(elem_type); }
sortByKey = List.SortByKey(list=code_block_5.elem_type, keys=code_block_5.elem_type_diameter)
code_block_6 = CodeBlock(elem_sorted=sortByKey.sorted_list)
# ---------- code_block_6.designscript (12 lines) ----------
elem_name = Revit.Elements.Element.Name(elem_sorted);

//InputName
"Diametro";
//Keys
elem_name;
//Values
elem_sorted;
//DefaultValueIndex
0;
//Sorted_optional
false;
# ----------------------------------------
dropdown_data = Custom[DropDown Data](InputName=code_block_6.out1, Keys=code_block_6.out2, Values=code_block_6.out3, DefaultValueIndex=code_block_6.out4, Sorted_optional=code_block_6.out5)  # package Data-Shapes; Create data for DropDown input in UI.MultiInputForm ++ . Check out www.data-shapes.net for more infos.
code_block_7 = CodeBlock { "Distanciamiento"; "200"; true; }
textbox_data = Custom[TextBox Data](InputName=code_block_7.out0, DefaultText=code_block_7.out1, IsNumberEntry=code_block_7.out2)  # package Data-Shapes; Create Data for TextBox input in UI.MultipleInputForm ++ . Check out www.data-shapes.net for more informations
list_create = List.Create(item0=dropdown_data, item1=textbox_data)
inputgroup_data = Custom[InputGroup Data](GroupTitle=code_block_4, Inputs=list_create)  # package Data-Shapes; Creates a group of inputs for UI.MultipleInputForm ++ . Check out www.data-shapes.net for more infos !
code_block_8 = CodeBlock { "Malla Horizontal"; }
element_types_ᶜᵒⁿᵛᵉʳᵗᵉᵈ_ᵈʳᵒᵖᵈᵒʷⁿ_2 = CodeBlock { DSCore.Types.FindTypeByNameInAssembly("RebarBarType", "RevitAPI"); }
all_elements_of_type_2 = ElementsOfType(element_type=element_types_ᶜᵒⁿᵛᵉʳᵗᵉᵈ_ᵈʳᵒᵖᵈᵒʷⁿ_2)
code_block_9 = CodeBlock(elem_type=all_elements_of_type_2) { elem_type; elem_type_diameter = Properties.RebarDiameter(elem_type); }
sortByKey_2 = List.SortByKey(list=code_block_9.elem_type, keys=code_block_9.elem_type_diameter)
code_block_10 = CodeBlock(elem_sorted=sortByKey_2.sorted_list)  # same code as code_block_6
dropdown_data_2 = Custom[DropDown Data](InputName=code_block_10.out1, Keys=code_block_10.out2, Values=code_block_10.out3, DefaultValueIndex=code_block_10.out4, Sorted_optional=code_block_10.out5)
code_block_11 = CodeBlock { "Distanciamiento"; "200"; true; }
textbox_data_2 = Custom[TextBox Data](InputName=code_block_11.out0, DefaultText=code_block_11.out1, IsNumberEntry=code_block_11.out2)
list_create_2 = List.Create(item0=dropdown_data_2, item1=textbox_data_2)
inputgroup_data_2 = Custom[InputGroup Data](GroupTitle=code_block_8, Inputs=list_create_2)
list_create_3 = List.Create(item0=selectmodelelements_data, item1=inputgroup_data, item2=inputgroup_data_2)
multipleinputform = Custom[MultipleInputForm ++](Description_optional=code_block_2, Logo_optional=file_path, ButtonText_optional=code_block_3.out0, Inputs=list_create_3, Toggle=code_block_3.out2, CancelButtonText_optional=code_block_3.out1, MaxHeight_optional=code_block_3.out5, Width_optional=code_block_3.out3, LabelWidth_optional=code_block_3.out4)  # package Data-Shapes; Create a form with multiple inputs. see www.data-shapes.net for tutorials and infos!
code_block_12 = CodeBlock(l=multipleinputform.User_Inputs)
# ---------- code_block_12.designscript (12 lines) ----------
l;
[Imperative]
{
	if (l == null)
	{
		return = [[],[],[],[],[]];
	}
	else
	{
		return = l;
	}
};
# ----------------------------------------
code_block_13 = CodeBlock(x=code_block_12.out1) { x; }
code_block_14 = CodeBlock(x=code_block_13) { coleccion = x[0]; categorias = Revit.Elements.Element.GetCategory(coleccion); }
string_from_object = FromObject(obj=code_block_14.categorias)
datos_mallas_para_etiqueta = CodeBlock(x=code_block_13, categorias=string_from_object)
# ---------- datos_mallas_para_etiqueta.designscript (23 lines) ----------
coleccion = x[0];
mask = categorias == "Walls";
DSCore.List.FilterByBoolMask(coleccion, mask)["in"];




//Malla Vertical
muros_v = x[0];
bar_v = x[1];
dist_v = x[2];
diam_bar_v = Properties.RebarDiameter(bar_v);
malla_v = "ø"+DSCore.Math.Ceiling(diam_bar_v)+"@"+DSCore.Math.Ceiling(dist_v);
Elements.View3D.SetParameterByName(muros_v<1L>, "Vertical", malla_v);


//Malla Horizontal
muros_h = x[0];
bar_h = x[3];
dist_h = x[4];
diam_bar_h = Properties.RebarDiameter(bar_h);
malla_h = "ø"+DSCore.Math.Ceiling(diam_bar_h)+"@"+DSCore.Math.Ceiling(dist_h);
Elements.View3D.SetParameterByName(muros_h<1L>, "Horizontal", malla_h);
# ----------------------------------------
current = Document.Current()
activeView = Document.ActiveView(document=current)
byJoinedCurves = PolyCurve.ByJoinedCurves()  # unwired: curves
intersect = Geometry.Intersect()  # unwired: geometry, other
byLoft = Surface.ByLoft()  # unwired: crossSections
code_block_15 = CodeBlock(x=code_block_12.out1) { x; }
code_block_16 = CodeBlock(malla_horizontal=code_block_15) { malla_horizontal[0]; malla_horizontal[3]; malla_horizontal[4]; }
geometry = Element.Geometry(element=code_block_16.out0)
flatten = List.Flatten(list=geometry)
centroid = Solid.Centroid(solid=flatten)
byOriginNormal = Plane.ByOriginNormal(origin=centroid)
intersect_2 = Geometry.Intersect(geometry=flatten, other=byOriginNormal)
flatten_2 = List.Flatten(list=intersect_2)
perimeterCurves = Surface.PerimeterCurves(surface=flatten_2)
code_block_17 = CodeBlock { [1,3]; }
getItemAtIndex = List.GetItemAtIndex(list=perimeterCurves@L2, index=code_block_17)
list_clean = Custom[List Clean](list=getItemAtIndex)  # package Genius Loci; Removes all Null, Empty and Blank from a list or nested list of lists.
code_block_18 = CodeBlock { 1000; }
extendEnd = Curve.ExtendEnd(curve=list_clean, distance=code_block_18)
extendStart = Curve.ExtendStart(curve=extendEnd, distance=code_block_18)
function_apply = ApplyFunction(func=byLoft, arg1=extendStart)
byUnion = Solid.ByUnion()  # unwired: solids
geometry_2 = Element.Geometry()  # unwired: element
filterByBoolMask = List.FilterByBoolMask()  # unwired: list, mask
get_joined_elements = Custom[Get Joined Elements](element=code_block_16.out0@L1)  # package Genius Loci; Returns all elements joined to the given element.
getCategory = Element.GetCategory()  # unwired: element
function_apply_2 = ApplyFunction(func=getCategory, arg1=get_joined_elements)
string_from_object_2 = FromObject(obj=function_apply_2)
code_block_19 = CodeBlock { "Walls"; }
eq = string_from_object_2 == code_block_19
function_apply_3 = ApplyFunction(func=filterByBoolMask.in, arg1=get_joined_elements, arg2=eq)
code_block_20 = CodeBlock(x=function_apply_3)
# ---------- code_block_20.designscript (13 lines) ----------
x;

[Imperative]
{
	if (x == null)
	{
		return = [];
	}
	else
	{
		return = x;
	}
};
# ----------------------------------------
count = List.Count(list=code_block_16.out0)
ofRepeatedItem = List.OfRepeatedItem(item=code_block_20.out1, amount=count)
addItemToFront = List.AddItemToFront(item=code_block_16.out0@L1, list=ofRepeatedItem@L2)
function_apply_4 = ApplyFunction(func=geometry_2, arg1=addItemToFront)
list_clean_2 = Custom[List Clean](list=function_apply_4)
flatten_3 = List.Flatten(list=list_clean_2@L3)
function_apply_5 = ApplyFunction(func=byUnion, arg1=flatten_3)
function_apply_6 = ApplyFunction(func=intersect, arg1=function_apply, arg2=function_apply_5)
code_block_21 = CodeBlock(x=function_apply_6)  # same code as code_block_20
flatten_4 = List.Flatten(list=code_block_21.out1)
version = Custom[Application.Version]()  # package Clockwork for Dynamo 2.x; Retrieves the name, version and build of the current Revit application.
normalAtPoint = Surface.NormalAtPoint(surface=flatten_4, point=centroid)
reverse = Vector.Reverse(vector=normalAtPoint)
python_script = Python(IN[0]=version.Version, IN[1]=normalAtPoint, IN[2]=reverse)
# ---------- python_script.python (10 lines) ----------
input = IN[0]
vector = IN[1]
vector_reverse = IN[2]

if input == 2024:
    res = vector_reverse
else:
    res = vector

OUT = res
# ----------------------------------------
code_block_22 = CodeBlock { "Unconnected Height"; }
getParameterValueByName = Element.GetParameterValueByName(element=code_block_16.out0, parameterName=code_block_22)
code_block_23 = CodeBlock(t2=getParameterValueByName) { t1 = t2 / 2; t3 = t1 - 100; t4 = t3 * -1; }
translate = Geometry.Translate(geometry=flatten_4, direction=python_script, distance=code_block_23.t4)
perimeterCurves_2 = Surface.PerimeterCurves(surface=translate)
function_apply_7 = ApplyFunction(func=byJoinedCurves, arg1=perimeterCurves_2)
code_block_24 = CodeBlock(l=function_apply_7)
# ---------- code_block_24.designscript (12 lines) ----------
l;
[Imperative]
{
	if (l == null)
	{
		return = [];
	}
	else
	{
		return = l;
	}
};
# ----------------------------------------
code_block_25 = CodeBlock { -20; }
offset = Curve.Offset(curve=code_block_24.out1, distance=code_block_25)
byJoinedCurves_2 = PolyCurve.ByJoinedCurves(curves=offset@L1)
curves = PolyCurve.Curves(polyCurve=byJoinedCurves_2)
code_block_26 = CodeBlock { [1,0]; }
getItemAtIndex_2 = List.GetItemAtIndex(list=curves@L2, index=code_block_26)
reverse_2 = Curve.Reverse(curve=getItemAtIndex_2)
element_types_ᶜᵒⁿᵛᵉʳᵗᵉᵈ_ᵈʳᵒᵖᵈᵒʷⁿ_3 = CodeBlock { DSCore.Types.FindTypeByNameInAssembly("RebarHookType", "RevitAPI"); }
all_elements_of_type_3 = ElementsOfType(element_type=element_types_ᶜᵒⁿᵛᵉʳᵗᵉᵈ_ᵈʳᵒᵖᵈᵒʷⁿ_3)
rebar_hook_type_at_start = CodeBlock(t3=all_elements_of_type_3)
# ---------- rebar_hook_type_at_start.designscript (6 lines) ----------
t1 = t3;
str2 = Revit.Elements.Element.Name(t1);
t2 = str2 == "Standard - 90 deg.";
t4 = DSCore.List.FilterByBoolMask(t3, t2);
t5 = Dictionary.ValueAtKey(t4, "in");
t6 = Dictionary.ValueAtKey(t4, "out");
# ----------------------------------------
code_block_27 = CodeBlock(RebarHookType=rebar_hook_type_at_start.t5, rebar_bar_type=code_block_16.out1)
# ---------- code_block_27.designscript (8 lines) ----------
//RebaarStyle
"Standard";
//RebarHookOrientation
"Right";
//Rebar Hook Type;
RebarHookType;
//RebarBarType
rebar_bar_type;
# ----------------------------------------
fromCurves = StructuralDesign.Rebar.Create.FromCurves(curves=reverse_2@L2, rebarStyle=code_block_27.out0@L1, rebarBarType=code_block_27.rebar_bar_type@L1, startHookType=code_block_27.RebarHookType@L1, endHookType=code_block_27.RebarHookType@L1, startHookOrientation=code_block_27.out1@L1, endHookOrientation=code_block_27.out1@L1, hostElement=code_block_16.out0@L1, vector=python_script@L1, lacing=Longest)
distanciamiento_barras = CodeBlock(distanciamiento_barras=code_block_16.out2) { distanciamiento_barras; }
code_block_28 = CodeBlock { 350; }
sub = getParameterValueByName - code_block_28
setLayoutAsMaximumSpacing = StructuralDesign.Rebar.Layout.SetLayoutAsMaximumSpacing(rebar=fromCurves, spacing=distanciamiento_barras, arrayLength=sub)
element_types_ᶜᵒⁿᵛᵉʳᵗᵉᵈ_ᵈʳᵒᵖᵈᵒʷⁿ_4 = CodeBlock { DSCore.Types.FindTypeByNameInAssembly("RebarShape", "RevitAPI"); }
all_elements_of_type_4 = ElementsOfType(element_type=element_types_ᶜᵒⁿᵛᵉʳᵗᵉᵈ_ᵈʳᵒᵖᵈᵒʷⁿ_4)
code_block_29 = CodeBlock(t1=all_elements_of_type_4)
# ---------- code_block_29.designscript (5 lines) ----------
"Shape";
str2 = Revit.Elements.Element.Name(t1);
t2 = str2 == "R_M_00";
t3 = DSCore.List.FilterByBoolMask(t1, t2);
t4 = Dictionary.ValueAtKey(t3, "in");
# ----------------------------------------
setParameterByName = Element.SetParameterByName(element=setLayoutAsMaximumSpacing, parameterName=code_block_29.out0, value=code_block_29.t4, lacing=Longest)
hideElements = archilab.Revit.Views.Views.HideElements(view=activeView, elements=setParameterByName)
current_2 = Document.Current()
activeView_2 = Document.ActiveView(document=current_2)
byJoinedCurves_3 = PolyCurve.ByJoinedCurves()  # unwired: curves
intersect_3 = Geometry.Intersect()  # unwired: geometry, other
byLoft_2 = Surface.ByLoft()  # unwired: crossSections
code_block_30 = CodeBlock(malla_horizontal=code_block_15) { malla_horizontal[0]; malla_horizontal[3]; malla_horizontal[4]; }
geometry_3 = Element.Geometry(element=code_block_30.out0)
flatten_5 = List.Flatten(list=geometry_3)
centroid_2 = Solid.Centroid(solid=flatten_5)
byOriginNormal_2 = Plane.ByOriginNormal(origin=centroid_2)
intersect_4 = Geometry.Intersect(geometry=flatten_5, other=byOriginNormal_2)
flatten_6 = List.Flatten(list=intersect_4)
perimeterCurves_3 = Surface.PerimeterCurves(surface=flatten_6)
code_block_31 = CodeBlock { [1,3]; }
getItemAtIndex_3 = List.GetItemAtIndex(list=perimeterCurves_3@L2, index=code_block_31)
list_clean_3 = Custom[List Clean](list=getItemAtIndex_3)
code_block_32 = CodeBlock { 1000; }
extendEnd_2 = Curve.ExtendEnd(curve=list_clean_3, distance=code_block_32)
extendStart_2 = Curve.ExtendStart(curve=extendEnd_2, distance=code_block_32)
function_apply_8 = ApplyFunction(func=byLoft_2, arg1=extendStart_2)
byUnion_2 = Solid.ByUnion()  # unwired: solids
geometry_4 = Element.Geometry()  # unwired: element
filterByBoolMask_2 = List.FilterByBoolMask()  # unwired: list, mask
get_joined_elements_2 = Custom[Get Joined Elements](element=code_block_30.out0@L1)
getCategory_2 = Element.GetCategory()  # unwired: element
function_apply_9 = ApplyFunction(func=getCategory_2, arg1=get_joined_elements_2)
string_from_object_3 = FromObject(obj=function_apply_9)
code_block_33 = CodeBlock { "Walls"; }
eq_2 = string_from_object_3 == code_block_33
function_apply_10 = ApplyFunction(func=filterByBoolMask_2.in, arg1=get_joined_elements_2, arg2=eq_2)
code_block_34 = CodeBlock(x=function_apply_10)  # same code as code_block_20
count_2 = List.Count(list=code_block_30.out0)
ofRepeatedItem_2 = List.OfRepeatedItem(item=code_block_34.out1, amount=count_2)
addItemToFront_2 = List.AddItemToFront(item=code_block_30.out0@L1, list=ofRepeatedItem_2@L2)
function_apply_11 = ApplyFunction(func=geometry_4, arg1=addItemToFront_2)
list_clean_4 = Custom[List Clean](list=function_apply_11)
flatten_7 = List.Flatten(list=list_clean_4@L3)
function_apply_12 = ApplyFunction(func=byUnion_2, arg1=flatten_7)
function_apply_13 = ApplyFunction(func=intersect_3, arg1=function_apply_8, arg2=function_apply_12)
code_block_35 = CodeBlock(x=function_apply_13)  # same code as code_block_20
flatten_8 = List.Flatten(list=code_block_35.out1)
version_2 = Custom[Application.Version]()
normalAtPoint_2 = Surface.NormalAtPoint(surface=flatten_8, point=centroid_2)
reverse_3 = Vector.Reverse(vector=normalAtPoint_2)
python_script_2 = Python(IN[0]=version_2.Version, IN[1]=normalAtPoint_2, IN[2]=reverse_3)  # same code as python_script
code_block_36 = CodeBlock { "Unconnected Height"; }
getParameterValueByName_2 = Element.GetParameterValueByName(element=code_block_30.out0, parameterName=code_block_36)
rebarDiameter = StructuralDesign.Rebar.Properties.RebarDiameter(rebar=code_block_30.out1)
code_block_37 = CodeBlock(t5=getParameterValueByName_2, num1=rebarDiameter) { t2 = t5; t1 = t2 / 2; t3 = t1 - 100; t4 = t3 * -1; t6 = t4 + num1; }
translate_2 = Geometry.Translate(geometry=flatten_8, direction=python_script_2, distance=code_block_37.t6)
perimeterCurves_4 = Surface.PerimeterCurves(surface=translate_2)
function_apply_14 = ApplyFunction(func=byJoinedCurves_3, arg1=perimeterCurves_4)
code_block_38 = CodeBlock(l=function_apply_14)  # same code as code_block_24
code_block_39 = CodeBlock { -20; }
offset_2 = Curve.Offset(curve=code_block_38.out1, distance=code_block_39)
byJoinedCurves_4 = PolyCurve.ByJoinedCurves(curves=offset_2@L1)
curves_2 = PolyCurve.Curves(polyCurve=byJoinedCurves_4)
code_block_40 = CodeBlock { [3,2]; }
getItemAtIndex_4 = List.GetItemAtIndex(list=curves_2@L2, index=code_block_40)
reverse_4 = Curve.Reverse(curve=getItemAtIndex_4)
element_types_ᶜᵒⁿᵛᵉʳᵗᵉᵈ_ᵈʳᵒᵖᵈᵒʷⁿ_5 = CodeBlock { DSCore.Types.FindTypeByNameInAssembly("RebarHookType", "RevitAPI"); }
all_elements_of_type_5 = ElementsOfType(element_type=element_types_ᶜᵒⁿᵛᵉʳᵗᵉᵈ_ᵈʳᵒᵖᵈᵒʷⁿ_5)
rebar_hook_type_at_start_2 = CodeBlock(t3=all_elements_of_type_5)  # same code as rebar_hook_type_at_start
code_block_41 = CodeBlock(RebarHookType=rebar_hook_type_at_start_2.t5, rebar_bar_type=code_block_30.out1)  # same code as code_block_27
fromCurves_2 = StructuralDesign.Rebar.Create.FromCurves(curves=reverse_4@L2, rebarStyle=code_block_41.out0@L1, rebarBarType=code_block_41.rebar_bar_type@L1, startHookType=code_block_41.RebarHookType@L1, endHookType=code_block_41.RebarHookType@L1, startHookOrientation=code_block_41.out1@L1, endHookOrientation=code_block_41.out1@L1, hostElement=code_block_30.out0@L1, vector=python_script_2@L1, lacing=Longest)
distanciamiento_barras_2 = CodeBlock(distanciamiento_barras=code_block_30.out2) { distanciamiento_barras; }
code_block_42 = CodeBlock { 350; }
sub_2 = getParameterValueByName_2 - code_block_42
setLayoutAsMaximumSpacing_2 = StructuralDesign.Rebar.Layout.SetLayoutAsMaximumSpacing(rebar=fromCurves_2, spacing=distanciamiento_barras_2, arrayLength=sub_2)
element_types_ᶜᵒⁿᵛᵉʳᵗᵉᵈ_ᵈʳᵒᵖᵈᵒʷⁿ_6 = CodeBlock { DSCore.Types.FindTypeByNameInAssembly("RebarShape", "RevitAPI"); }
all_elements_of_type_6 = ElementsOfType(element_type=element_types_ᶜᵒⁿᵛᵉʳᵗᵉᵈ_ᵈʳᵒᵖᵈᵒʷⁿ_6)
code_block_43 = CodeBlock(t1=all_elements_of_type_6)  # same code as code_block_29
setParameterByName_2 = Element.SetParameterByName(element=setLayoutAsMaximumSpacing_2, parameterName=code_block_43.out0, value=code_block_43.t4, lacing=Longest)
hideElements_2 = archilab.Revit.Views.Views.HideElements(view=activeView_2, elements=setParameterByName_2)
current_3 = Document.Current()
activeView_3 = Document.ActiveView(document=current_3)
byJoinedCurves_5 = PolyCurve.ByJoinedCurves()  # unwired: curves
code_block_44 = CodeBlock(x=code_block_12.out1) { x; }
code_block_45 = CodeBlock(malla_vertical=code_block_44) { malla_vertical[0]; malla_vertical[1]; malla_vertical[2]; malla_vertical[3]; }
muros = CodeBlock(x=code_block_45.out0) { x; }
geometry_5 = Element.Geometry(element=muros)
flatten_9 = List.Flatten(list=geometry_5)
getLocation = Element.GetLocation(element=muros)
code_block_46 = CodeBlock { 0.5; }
planeAtParameter = Curve.PlaneAtParameter(curve=getLocation, param=code_block_46)
intersect_5 = Geometry.Intersect(geometry=flatten_9, other=planeAtParameter)
flatten_10 = List.Flatten(list=intersect_5)
centroid_3 = Solid.Centroid(solid=flatten_9)
normalAtPoint_3 = Surface.NormalAtPoint(surface=flatten_10, point=centroid_3)
code_block_47 = CodeBlock { "Length"; }
getParameterValueByName_3 = Element.GetParameterValueByName(element=muros, parameterName=code_block_47)
round = Math.Round(number=getParameterValueByName_3)
rebarDiameter_2 = StructuralDesign.Rebar.Properties.RebarDiameter(rebar=code_block_45.out1)
code_block_48 = CodeBlock(t2=round, barDiameter=rebarDiameter_2) { t1 = t2 / 2; t3 = t1 - 200; t4 = t3 * -1 + barDiameter; }
translate_3 = Geometry.Translate(geometry=flatten_10, direction=normalAtPoint_3, distance=code_block_48.t4)
perimeterCurves_5 = Surface.PerimeterCurves(surface=translate_3)
function_apply_15 = ApplyFunction(func=byJoinedCurves_5, arg1=perimeterCurves_5)
calculo_posicion_malla_vertical = CodeBlock(t1=code_block_45.out1, t3=code_block_45.out3) { num2 = Properties.RebarDiameter(t1); t2 = num2 / 2; num3 = Properties.RebarDiameter(t3); t4 = t2 + num3; }
code_block_49 = CodeBlock(offSetMalla=calculo_posicion_malla_vertical.t4) { -20-offSetMalla; }
offset_3 = Curve.Offset(curve=function_apply_15, distance=code_block_49)
byJoinedCurves_6 = PolyCurve.ByJoinedCurves(curves=offset_3@L1)
curves_3 = PolyCurve.Curves(polyCurve=byJoinedCurves_6)
version_3 = Custom[Application.Version]()
python_script_3 = Python(IN[0]=version_3.Version)
# ---------- python_script_3.python (8 lines) ----------
input = IN[0]

if input == 2024:
    input = 3
else:
    input = 0

OUT = input
# ----------------------------------------
getItemAtIndex_5 = List.GetItemAtIndex(list=curves_3@L2, index=python_script_3)
code_block_50 = CodeBlock(t1=getItemAtIndex_5)
# ---------- code_block_50.designscript (6 lines) ----------
point1 = Autodesk.Curve.StartPoint(t1);
point2 = Autodesk.Curve.EndPoint(t1);
vector1 = Autodesk.Vector.ByTwoPoints(point1, point2);
num2 = Autodesk.Vector.Z(vector1);
t2 = num2 < 0;
curve1 = Autodesk.Curve.Reverse(t1);
# ----------------------------------------
if_ = If(test=code_block_50.t2, true=code_block_50.curve1, false=getItemAtIndex_5)
traslapo_armadura = CodeBlock(rebar=code_block_45.out1, offsetMalla=calculo_posicion_malla_vertical.t4)
# ---------- traslapo_armadura.designscript (5 lines) ----------
diametro_barra = Strings.ToString(Properties.RebarDiameter(rebar),"");
key = ["8","10","12","16","18","22","25","28","32","36"];
val = [570, 710, 860, 1140, 1290, 1960, 2230, 2500, 2850, 3210];
dict_traslapo = Dictionary.ByKeysValues(key, val);
t3 = Dictionary.ValueAtKey(dict_traslapo, diametro_barra) + offsetMalla + 20;
# ----------------------------------------
extendEnd_3 = Curve.ExtendEnd(curve=if_, distance=traslapo_armadura.t3)
code_block_51 = CodeBlock(offsetMalla=calculo_posicion_malla_vertical.t4) { 20+offsetMalla; }
extendStart_3 = Curve.ExtendStart(curve=extendEnd_3, distance=code_block_51)
code_block_52 = CodeBlock(rebar_bar_type=code_block_45.out1)
# ---------- code_block_52.designscript (8 lines) ----------
//RebaarStyle
"Standard";
//RebarHookOrientation
"Left";
//Rebar Hook Type;
null;
//RebarBarType
rebar_bar_type;
# ----------------------------------------
fromCurves_3 = StructuralDesign.Rebar.Create.FromCurves(curves=extendStart_3@L1, rebarStyle=code_block_52.out0@L1, rebarBarType=code_block_52.rebar_bar_type@L1, startHookType=code_block_52.out2@L1, endHookType=code_block_52.out2@L1, startHookOrientation=code_block_52.out1@L1, endHookOrientation=code_block_52.out1@L1, hostElement=code_block_45.out0@L1, vector=normalAtPoint_3@L1, lacing=Longest)
distanciamiento_barras_3 = CodeBlock(distanciamiento_barras=code_block_45.out2) { distanciamiento_barras; }
code_block_53 = CodeBlock { 400; }
sub_3 = round - code_block_53
setLayoutAsMaximumSpacing_3 = StructuralDesign.Rebar.Layout.SetLayoutAsMaximumSpacing(rebar=fromCurves_3, spacing=distanciamiento_barras_3, arrayLength=sub_3)
element_types_ᶜᵒⁿᵛᵉʳᵗᵉᵈ_ᵈʳᵒᵖᵈᵒʷⁿ_7 = CodeBlock { DSCore.Types.FindTypeByNameInAssembly("RebarShape", "RevitAPI"); }
all_elements_of_type_7 = ElementsOfType(element_type=element_types_ᶜᵒⁿᵛᵉʳᵗᵉᵈ_ᵈʳᵒᵖᵈᵒʷⁿ_7)
code_block_54 = CodeBlock(t1=all_elements_of_type_7)
# ---------- code_block_54.designscript (5 lines) ----------
"Shape";
str2 = Revit.Elements.Element.Name(t1);
t2 = str2 == "R_M_02";
t3 = DSCore.List.FilterByBoolMask(t1, t2);
t4 = Dictionary.ValueAtKey(t3, "in");
# ----------------------------------------
setParameterByName_3 = Element.SetParameterByName(element=setLayoutAsMaximumSpacing_3, parameterName=code_block_54.out0, value=code_block_54.t4, lacing=Longest)
hideElements_3 = archilab.Revit.Views.Views.HideElements(view=activeView_3, elements=setParameterByName_3)
current_4 = Document.Current()
activeView_4 = Document.ActiveView(document=current_4)
byJoinedCurves_7 = PolyCurve.ByJoinedCurves()  # unwired: curves
code_block_55 = CodeBlock(malla_vertical=code_block_44) { malla_vertical[0]; malla_vertical[1]; malla_vertical[2]; malla_vertical[3]; }
muros_2 = CodeBlock(x=code_block_55.out0) { x; }
geometry_6 = Element.Geometry(element=muros_2)
flatten_11 = List.Flatten(list=geometry_6)
getLocation_2 = Element.GetLocation(element=muros_2)
code_block_56 = CodeBlock { 0.5; }
planeAtParameter_2 = Curve.PlaneAtParameter(curve=getLocation_2, param=code_block_56)
intersect_6 = Geometry.Intersect(geometry=flatten_11, other=planeAtParameter_2)
flatten_12 = List.Flatten(list=intersect_6)
centroid_4 = Solid.Centroid(solid=flatten_11)
normalAtPoint_4 = Surface.NormalAtPoint(surface=flatten_12, point=centroid_4)
code_block_57 = CodeBlock { "Length"; }
getParameterValueByName_4 = Element.GetParameterValueByName(element=muros_2, parameterName=code_block_57)
round_2 = Math.Round(number=getParameterValueByName_4)
code_block_58 = CodeBlock(t2=round_2) { t1 = t2 / 2; t3 = t1 - 200; t4 = t3 * -1; }
translate_4 = Geometry.Translate(geometry=flatten_12, direction=normalAtPoint_4, distance=code_block_58.t4)
perimeterCurves_6 = Surface.PerimeterCurves(surface=translate_4)
function_apply_16 = ApplyFunction(func=byJoinedCurves_7, arg1=perimeterCurves_6)
calculo_posicion_malla_vertical_2 = CodeBlock(t1=code_block_55.out1, t3=code_block_55.out3) { num2 = Properties.RebarDiameter(t1); t2 = num2 / 2; num3 = Properties.RebarDiameter(t3); t4 = t2 + num3; }
code_block_59 = CodeBlock(offSetMalla=calculo_posicion_malla_vertical_2.t4) { -20-offSetMalla; }
offset_4 = Curve.Offset(curve=function_apply_16, distance=code_block_59)
byJoinedCurves_8 = PolyCurve.ByJoinedCurves(curves=offset_4@L1)
curves_4 = PolyCurve.Curves(polyCurve=byJoinedCurves_8)
version_4 = Custom[Application.Version]()
python_script_4 = Python(IN[0]=version_4.Version)
# ---------- python_script_4.python (8 lines) ----------
input = IN[0]

if input == 2024:
    input = 1
else:
    input = 2

OUT = input
# ----------------------------------------
getItemAtIndex_6 = List.GetItemAtIndex(list=curves_4@L2, index=python_script_4)
code_block_60 = CodeBlock(t1=getItemAtIndex_6)  # same code as code_block_50
if_2 = If(test=code_block_60.t2, true=code_block_60.curve1, false=getItemAtIndex_6)
traslapo_armadura_2 = CodeBlock(rebar=code_block_55.out1, offsetMalla=calculo_posicion_malla_vertical_2.t4)  # same code as traslapo_armadura
extendEnd_4 = Curve.ExtendEnd(curve=if_2, distance=traslapo_armadura_2.t3)
code_block_61 = CodeBlock(offsetMalla=calculo_posicion_malla_vertical_2.t4) { 20+offsetMalla; }
extendStart_4 = Curve.ExtendStart(curve=extendEnd_4, distance=code_block_61)
code_block_62 = CodeBlock(rebar_bar_type=code_block_55.out1)  # same code as code_block_52
fromCurves_4 = StructuralDesign.Rebar.Create.FromCurves(curves=extendStart_4@L1, rebarStyle=code_block_62.out0@L1, rebarBarType=code_block_62.rebar_bar_type@L1, startHookType=code_block_62.out2@L1, endHookType=code_block_62.out2@L1, startHookOrientation=code_block_62.out1@L1, endHookOrientation=code_block_62.out1@L1, hostElement=code_block_55.out0@L1, vector=normalAtPoint_4@L1, lacing=Longest)
distanciamiento_barras_4 = CodeBlock(distanciamiento_barras=code_block_55.out2) { distanciamiento_barras; }
code_block_63 = CodeBlock { 400; }
sub_4 = round_2 - code_block_63
setLayoutAsMaximumSpacing_4 = StructuralDesign.Rebar.Layout.SetLayoutAsMaximumSpacing(rebar=fromCurves_4, spacing=distanciamiento_barras_4, arrayLength=sub_4)
element_types_ᶜᵒⁿᵛᵉʳᵗᵉᵈ_ᵈʳᵒᵖᵈᵒʷⁿ_8 = CodeBlock { DSCore.Types.FindTypeByNameInAssembly("RebarShape", "RevitAPI"); }
all_elements_of_type_8 = ElementsOfType(element_type=element_types_ᶜᵒⁿᵛᵉʳᵗᵉᵈ_ᵈʳᵒᵖᵈᵒʷⁿ_8)
code_block_64 = CodeBlock(t1=all_elements_of_type_8)  # same code as code_block_54
setParameterByName_4 = Element.SetParameterByName(element=setLayoutAsMaximumSpacing_4, parameterName=code_block_64.out0, value=code_block_64.t4, lacing=Longest)
hideElements_4 = archilab.Revit.Views.Views.HideElements(view=activeView_4, elements=setParameterByName_4)
