# Dynamo graph script.dyn (Dynamo 2.6.2.15705)
# packages: Data-Shapes 2022.2.103, Structural Design 2021.1.22, Clockwork for Dynamo 2.x 2.4.0, Genius Loci 2021.11.10, Crumple 2022.2.13, archi-lab.net 2022.210.2419

byLoft = Surface.ByLoft()  # unwired: crossSections
byJoinedCurves = PolyCurve.ByJoinedCurves()  # unwired: curves
code_block = CodeBlock { "Doble Malla - Malla Simple (Fundación - Muro)"; }
file_path = Filename("..\..\..\..\..\..\..\..\..\..\Arainco\Arainco.png")
code_block_2 = CodeBlock { "INICIAR"; "CANCELAR"; true; 430; 170; 650; }
categories_ᶜᵒⁿᵛᵉʳᵗᵉᵈ_ᵈʳᵒᵖᵈᵒʷⁿ = CodeBlock()
# ---------- categories_ᶜᵒⁿᵛᵉʳᵗᵉᵈ_ᵈʳᵒᵖᵈᵒʷⁿ.designscript (4 lines) ----------
"Seleccionar Muro\ny Fundación";
"SELECCIONAR";
t1 = ["Walls", "Structural Foundations"];
category1 = Revit.Category.ByName(t1);
# ----------------------------------------
selectmodelelements_data = Custom[SelectModelElements Data](InputName=categories_ᶜᵒⁿᵛᵉʳᵗᵉᵈ_ᵈʳᵒᵖᵈᵒʷⁿ.out0, ButtonText=categories_ᶜᵒⁿᵛᵉʳᵗᵉᵈ_ᵈʳᵒᵖᵈᵒʷⁿ.out1, CategoryFilter=categories_ᶜᵒⁿᵛᵉʳᵗᵉᵈ_ᵈʳᵒᵖᵈᵒʷⁿ.category1)  # package Data-Shapes; Creates a Revit element selection input for UI.MultipleInputForm++ . Check out www.data-shapes.net for more infos!
code_block_3 = CodeBlock { "Malla Vertical"; }
element_types_ᶜᵒⁿᵛᵉʳᵗᵉᵈ_ᵈʳᵒᵖᵈᵒʷⁿ = CodeBlock { DSCore.Types.FindTypeByNameInAssembly("RebarBarType", "RevitAPI"); }
all_elements_of_type = ElementsOfType(element_type=element_types_ᶜᵒⁿᵛᵉʳᵗᵉᵈ_ᵈʳᵒᵖᵈᵒʷⁿ)
code_block_4 = CodeBlock(elem_type=all_elements_of_type) { elem_type; elem_type_diameter = Properties.RebarDiameter(elem_type); }
sortByKey = List.SortByKey(list=code_block_4.elem_type, keys=code_block_4.elem_type_diameter)
code_block_5 = CodeBlock(elem_sorted=sortByKey.sorted_list)
# ---------- code_block_5.designscript (12 lines) ----------
elem_name = Revit.Elements.Element.Name(elem_sorted);

//InputName
"Diametro";
//Keys
elem_name;
//Values
elem_sorted;
//DefaultValueIndex
0;
//Sorted_optional
false;
# ----------------------------------------
dropdown_data = Custom[DropDown Data](InputName=code_block_5.out1, Keys=code_block_5.out2, Values=code_block_5.out3, DefaultValueIndex=code_block_5.out4, Sorted_optional=code_block_5.out5)  # package Data-Shapes; Create data for DropDown input in UI.MultiInputForm ++ . Check out www.data-shapes.net for more infos.
code_block_6 = CodeBlock { "Distanciamiento"; "200"; true; }
textbox_data = Custom[TextBox Data](InputName=code_block_6.out0, DefaultText=code_block_6.out1, IsNumberEntry=code_block_6.out2)  # package Data-Shapes; Create Data for TextBox input in UI.MultipleInputForm ++ . Check out www.data-shapes.net for more informations
list_create = List.Create(item0=dropdown_data, item1=textbox_data)
inputgroup_data = Custom[InputGroup Data](GroupTitle=code_block_3, Inputs=list_create)  # package Data-Shapes; Creates a group of inputs for UI.MultipleInputForm ++ . Check out www.data-shapes.net for more infos !
code_block_7 = CodeBlock { "Malla Horizontal"; }
element_types_ᶜᵒⁿᵛᵉʳᵗᵉᵈ_ᵈʳᵒᵖᵈᵒʷⁿ_2 = CodeBlock { DSCore.Types.FindTypeByNameInAssembly("RebarBarType", "RevitAPI"); }
all_elements_of_type_2 = ElementsOfType(element_type=element_types_ᶜᵒⁿᵛᵉʳᵗᵉᵈ_ᵈʳᵒᵖᵈᵒʷⁿ_2)
code_block_8 = CodeBlock(elem_type=all_elements_of_type_2) { elem_type; elem_type_diameter = Properties.RebarDiameter(elem_type); }
sortByKey_2 = List.SortByKey(list=code_block_8.elem_type, keys=code_block_8.elem_type_diameter)
code_block_9 = CodeBlock(elem_sorted=sortByKey_2.sorted_list)  # same code as code_block_5
dropdown_data_2 = Custom[DropDown Data](InputName=code_block_9.out1, Keys=code_block_9.out2, Values=code_block_9.out3, DefaultValueIndex=code_block_9.out4, Sorted_optional=code_block_9.out5)
code_block_10 = CodeBlock { "Distanciamiento"; "200"; true; }
textbox_data_2 = Custom[TextBox Data](InputName=code_block_10.out0, DefaultText=code_block_10.out1, IsNumberEntry=code_block_10.out2)
list_create_2 = List.Create(item0=dropdown_data_2, item1=textbox_data_2)
inputgroup_data_2 = Custom[InputGroup Data](GroupTitle=code_block_7, Inputs=list_create_2)
list_create_3 = List.Create(item0=selectmodelelements_data, item1=inputgroup_data, item2=inputgroup_data_2)
multipleinputform = Custom[MultipleInputForm ++](Description_optional=code_block, Logo_optional=file_path, ButtonText_optional=code_block_2.out0, Inputs=list_create_3, Toggle=code_block_2.out2, CancelButtonText_optional=code_block_2.out1, MaxHeight_optional=code_block_2.out5, Width_optional=code_block_2.out3, LabelWidth_optional=code_block_2.out4)  # package Data-Shapes; Create a form with multiple inputs. see www.data-shapes.net for tutorials and infos!
code_block_11 = CodeBlock(l=multipleinputform.User_Inputs)
# ---------- code_block_11.designscript (12 lines) ----------
l;
[Imperative]
{
	if (l == null)
	{
		return = [[],[],[],[],[],[]];
	}
	else
	{
		return = l;
	}
};
# ----------------------------------------
code_block_12 = CodeBlock(x=code_block_11.out1) { x; }
code_block_13 = CodeBlock(malla_vertical=code_block_12) { malla_vertical[0]; malla_vertical[1]; malla_vertical[2]; malla_vertical[3]; }
code_block_14 = CodeBlock(x=code_block_13.out0) { x; }
code_block_15 = CodeBlock(x=code_block_14) { x; }
getCategory = Element.GetCategory(element=code_block_15)
string_from_object = FromObject(obj=getCategory)
code_block_16 = CodeBlock { "Walls"; }
eq = string_from_object == code_block_16
filterByBoolMask = List.FilterByBoolMask(list=code_block_15, mask=eq)
geometry = Element.Geometry(element=filterByBoolMask.in)
flatten = List.Flatten(list=geometry)
getLocation = Element.GetLocation(element=filterByBoolMask.in)
code_block_17 = CodeBlock { 0.5; }
planeAtParameter = Curve.PlaneAtParameter(curve=getLocation, param=code_block_17)
intersect = Geometry.Intersect(geometry=flatten, other=planeAtParameter)
perimeterCurves = Surface.PerimeterCurves(surface=intersect)
flatten_2 = List.Flatten(list=perimeterCurves)
function_apply = ApplyFunction(func=byJoinedCurves, arg1=flatten_2)
curves = PolyCurve.Curves(polyCurve=function_apply)
code_block_18 = CodeBlock { [0,2]; }
getItemAtIndex = List.GetItemAtIndex(list=curves@L2, index=code_block_18)
code_block_19 = CodeBlock { 8000; }
extendStart = Curve.ExtendStart(curve=getItemAtIndex, distance=code_block_19)
extendEnd = Curve.ExtendEnd(curve=extendStart, distance=code_block_19)
function_apply_2 = ApplyFunction(func=byLoft, arg1=extendEnd)
byUnion = Solid.ByUnion()  # unwired: solids
code_block_20 = CodeBlock(x=code_block_14) { x; }
geometry_2 = Element.Geometry(element=code_block_20)
flatten_3 = List.Flatten(list=geometry_2)
function_apply_3 = ApplyFunction(func=byUnion, arg1=flatten_3)
code_block_21 = CodeBlock(x=function_apply_3)
# ---------- code_block_21.designscript (13 lines) ----------
x;

[Imperative]
{
	if (x == null)
	{
		return = [];
	}
	else
	{
		return = x;
	}
};
# ----------------------------------------
intersect_2 = Geometry.Intersect(geometry=function_apply_2, other=code_block_21.out1)
flatten_4 = List.Flatten(list=intersect_2)
elementcentroid = Custom[© ElementCentroid](element=filterByBoolMask.in)  # package Crumple; Returns the centroid of the element's axis-aligned bounding box.
normalAtPoint = Surface.NormalAtPoint(surface=flatten_4, point=elementcentroid)
code_block_22 = CodeBlock(vector1=normalAtPoint) { plane1 = Autodesk.Plane.XY(); vector2 = Autodesk.Vector.Rotate(vector1, plane1, 90); }
byLoft_2 = Surface.ByLoft()  # unwired: crossSections
byJoinedCurves_2 = PolyCurve.ByJoinedCurves()  # unwired: curves
code_block_23 = CodeBlock(malla_vertical=code_block_12) { malla_vertical[0]; malla_vertical[1]; malla_vertical[2]; malla_vertical[3]; }
code_block_24 = CodeBlock(x=code_block_23.out0) { x; }
code_block_25 = CodeBlock(x=code_block_24) { x; }
getCategory_2 = Element.GetCategory(element=code_block_25)
string_from_object_2 = FromObject(obj=getCategory_2)
code_block_26 = CodeBlock { "Walls"; }
eq_2 = string_from_object_2 == code_block_26
filterByBoolMask_2 = List.FilterByBoolMask(list=code_block_25, mask=eq_2)
geometry_3 = Element.Geometry(element=filterByBoolMask_2.in)
flatten_5 = List.Flatten(list=geometry_3)
getLocation_2 = Element.GetLocation(element=filterByBoolMask_2.in)
code_block_27 = CodeBlock { 0.5; }
planeAtParameter_2 = Curve.PlaneAtParameter(curve=getLocation_2, param=code_block_27)
intersect_3 = Geometry.Intersect(geometry=flatten_5, other=planeAtParameter_2)
perimeterCurves_2 = Surface.PerimeterCurves(surface=intersect_3)
flatten_6 = List.Flatten(list=perimeterCurves_2)
function_apply_4 = ApplyFunction(func=byJoinedCurves_2, arg1=flatten_6)
code_block_28 = CodeBlock(x=function_apply_4)  # same code as code_block_21
curves_2 = PolyCurve.Curves(polyCurve=code_block_28.out1)
code_block_29 = CodeBlock { null; }
replaceEmptyLists = Custom[List.ReplaceEmptyLists](seq=curves_2, Replacement=code_block_29)  # package Clockwork for Dynamo 2.x; Replaces all empty lists within a given list with a substitute
code_block_30 = CodeBlock(x=replaceEmptyLists)
# ---------- code_block_30.designscript (13 lines) ----------
x;

[Imperative]
{
	if (x == null)
	{
		return = [null,null,null];
	}
	else
	{
		return = x;
	}
};
# ----------------------------------------
code_block_31 = CodeBlock { [0,2]; }
getItemAtIndex_2 = List.GetItemAtIndex(list=code_block_30.out1@L2, index=code_block_31)
code_block_32 = CodeBlock(l=getItemAtIndex_2)
# ---------- code_block_32.designscript (12 lines) ----------
l;
[Imperative]
{
	if (l[0][0] == null)
	{
		return = [];
	}
	else
	{
		return = l;
	}
};
# ----------------------------------------
code_block_33 = CodeBlock { 8000; }
extendStart_2 = Curve.ExtendStart(curve=code_block_32.out1, distance=code_block_33)
extendEnd_2 = Curve.ExtendEnd(curve=extendStart_2, distance=code_block_33)
function_apply_5 = ApplyFunction(func=byLoft_2, arg1=extendEnd_2)
byUnion_2 = Solid.ByUnion()  # unwired: solids
code_block_34 = CodeBlock(x=code_block_24) { x; }
geometry_4 = Element.Geometry(element=code_block_34)
flatten_7 = List.Flatten(list=geometry_4)
function_apply_6 = ApplyFunction(func=byUnion_2, arg1=flatten_7)
code_block_35 = CodeBlock(x=function_apply_6)  # same code as code_block_21
intersect_4 = Geometry.Intersect(geometry=function_apply_5, other=code_block_35.out1)
flatten_8 = List.Flatten(list=intersect_4)
elementcentroid_2 = Custom[© ElementCentroid](element=filterByBoolMask_2.in)
normalAtPoint_2 = Surface.NormalAtPoint(surface=flatten_8, point=elementcentroid_2)
code_block_36 = CodeBlock(vector1=normalAtPoint_2) { plane1 = Autodesk.Plane.XY(); vector2 = Autodesk.Vector.Rotate(vector1, plane1, 90); }
code_block_37 = CodeBlock(x=code_block_11.out1) { x; }
code_block_38 = CodeBlock(x=code_block_37) { coleccion = x[0]; categorias = Revit.Elements.Element.GetCategory(coleccion); }
string_from_object_3 = FromObject(obj=code_block_38.categorias)
datos_mallas_para_etiqueta = CodeBlock(x=code_block_37, categorias=string_from_object_3)
# ---------- datos_mallas_para_etiqueta.designscript (23 lines) ----------
coleccion = x[0];
mask = categorias == "Walls";
DSCore.List.FilterByBoolMask(coleccion, mask)["in"];




//Malla Vertical
muros_v = x[0];
bar_v = x[1];
dist_v = x[2];
diam_bar_v = Properties.RebarDiameter(bar_v);
malla_v = "ø"+DSCore.Math.Ceiling(diam_bar_v)+"@"+DSCore.Math.Ceiling(dist_v);
Elements.View3D.SetParameterByName(muros_v<1L>, "Vertical", malla_v);


//Malla Horizontal
muros_h = x[0];
bar_h = x[3];
dist_h = x[4];
diam_bar_h = Properties.RebarDiameter(bar_h);
malla_h = "ø"+DSCore.Math.Ceiling(diam_bar_h)+"@"+DSCore.Math.Ceiling(dist_h);
Elements.View3D.SetParameterByName(muros_h<1L>, "Horizontal", malla_h);
# ----------------------------------------
current = Document.Current()
activeView = Document.ActiveView(document=current)
byJoinedCurves_3 = PolyCurve.ByJoinedCurves()  # unwired: curves
intersect_5 = Geometry.Intersect()  # unwired: geometry, other
byLoft_3 = Surface.ByLoft()  # unwired: crossSections
code_block_39 = CodeBlock(x=code_block_11.out1) { x; }
code_block_40 = CodeBlock(malla_horizontal=code_block_39) { malla_horizontal[0]; malla_horizontal[3]; malla_horizontal[4]; }
code_block_41 = CodeBlock(x=code_block_40.out0) { x; }
getCategory_3 = Element.GetCategory(element=code_block_41)
string_from_object_4 = FromObject(obj=getCategory_3)
code_block_42 = CodeBlock { "Walls"; }
eq_3 = string_from_object_4 == code_block_42
filterByBoolMask_3 = List.FilterByBoolMask(list=code_block_41, mask=eq_3)
geometry_5 = Element.Geometry(element=filterByBoolMask_3.in)
flatten_9 = List.Flatten(list=geometry_5)
centroid = Solid.Centroid(solid=flatten_9)
byOriginNormal = Plane.ByOriginNormal(origin=centroid)
intersect_6 = Geometry.Intersect(geometry=flatten_9, other=byOriginNormal)
flatten_10 = List.Flatten(list=intersect_6)
perimeterCurves_3 = Surface.PerimeterCurves(surface=flatten_10)
code_block_43 = CodeBlock { null; }
replaceEmptyLists_2 = Custom[List.ReplaceEmptyLists](seq=perimeterCurves_3, Replacement=code_block_43)
code_block_44 = CodeBlock(x=replaceEmptyLists_2)
# ---------- code_block_44.designscript (13 lines) ----------
x;

[Imperative]
{
	if (x == null)
	{
		return = [null,null,null,null];
	}
	else
	{
		return = x;
	}
};
# ----------------------------------------
code_block_45 = CodeBlock { [1,3]; }
getItemAtIndex_3 = List.GetItemAtIndex(list=code_block_44.out1@L2, index=code_block_45)
list_clean = Custom[List Clean](list=getItemAtIndex_3)  # package Genius Loci; Removes all Null, Empty and Blank from a list or nested list of lists.
code_block_46 = CodeBlock { 1000; }
extendEnd_3 = Curve.ExtendEnd(curve=list_clean, distance=code_block_46)
extendStart_3 = Curve.ExtendStart(curve=extendEnd_3, distance=code_block_46)
function_apply_7 = ApplyFunction(func=byLoft_3, arg1=extendStart_3)
byUnion_3 = Solid.ByUnion()  # unwired: solids
geometry_6 = Element.Geometry()  # unwired: element
filterByBoolMask_4 = List.FilterByBoolMask()  # unwired: list, mask
get_joined_elements = Custom[Get Joined Elements](element=filterByBoolMask_3.in@L1)  # package Genius Loci; Returns all elements joined to the given element.
getCategory_4 = Element.GetCategory()  # unwired: element
function_apply_8 = ApplyFunction(func=getCategory_4, arg1=get_joined_elements)
string_from_object_5 = FromObject(obj=function_apply_8)
code_block_47 = CodeBlock { "Walls"; }
eq_4 = string_from_object_5 == code_block_47
function_apply_9 = ApplyFunction(func=filterByBoolMask_4.in, arg1=get_joined_elements, arg2=eq_4)
code_block_48 = CodeBlock(x=function_apply_9)  # same code as code_block_21
count = List.Count(list=filterByBoolMask_3.in)
ofRepeatedItem = List.OfRepeatedItem(item=code_block_48.out1, amount=count)
addItemToFront = List.AddItemToFront(item=filterByBoolMask_3.in@L1, list=ofRepeatedItem@L2)
function_apply_10 = ApplyFunction(func=geometry_6, arg1=addItemToFront)
list_clean_2 = Custom[List Clean](list=function_apply_10)
flatten_11 = List.Flatten(list=list_clean_2@L3)
function_apply_11 = ApplyFunction(func=byUnion_3, arg1=flatten_11)
function_apply_12 = ApplyFunction(func=intersect_5, arg1=function_apply_7, arg2=function_apply_11)
code_block_49 = CodeBlock(x=function_apply_12)  # same code as code_block_21
flatten_12 = List.Flatten(list=code_block_49.out1)
normalAtPoint_3 = Surface.NormalAtPoint(surface=flatten_12, point=centroid)
code_block_50 = CodeBlock { "Unconnected Height"; }
getParameterValueByName = Element.GetParameterValueByName(element=filterByBoolMask_3.in, parameterName=code_block_50)
rebarDiameter = StructuralDesign.Rebar.Properties.RebarDiameter(rebar=code_block_40.out1)
code_block_51 = CodeBlock(t5=getParameterValueByName, num1=rebarDiameter) { t2 = t5; t1 = t2 / 2; t3 = t1 - 100; t4 = t3 * -1; t6 = t4 + num1; }
translate = Geometry.Translate(geometry=flatten_12, direction=normalAtPoint_3, distance=code_block_51.t6)
perimeterCurves_4 = Surface.PerimeterCurves(surface=translate)
function_apply_13 = ApplyFunction(func=byJoinedCurves_3, arg1=perimeterCurves_4)
code_block_52 = CodeBlock(l=function_apply_13)
# ---------- code_block_52.designscript (12 lines) ----------
l;
[Imperative]
{
	if (l == null)
	{
		return = [];
	}
	else
	{
		return = l;
	}
};
# ----------------------------------------
code_block_53 = CodeBlock { -20; }
offset = Curve.Offset(curve=code_block_52.out1, distance=code_block_53)
byJoinedCurves_4 = PolyCurve.ByJoinedCurves(curves=offset@L1)
curves_3 = PolyCurve.Curves(polyCurve=byJoinedCurves_4)
code_block_54 = CodeBlock { null; }
replaceEmptyLists_3 = Custom[List.ReplaceEmptyLists](seq=curves_3, Replacement=code_block_54)
code_block_55 = CodeBlock(x=replaceEmptyLists_3)  # same code as code_block_44
code_block_56 = CodeBlock { [2,3]; }
getItemAtIndex_4 = List.GetItemAtIndex(list=code_block_55.out1@L2, index=code_block_56)
code_block_57 = CodeBlock(rebar_bar_type=code_block_40.out1)
# ---------- code_block_57.designscript (8 lines) ----------
//RebaarStyle
"Standard";
//RebarHookOrientation
"Right";
//Rebar Hook Type;
Revit.Elements.ElementSelector.ByElementId(474495);
//RebarBarType
rebar_bar_type;
# ----------------------------------------
fromCurves = StructuralDesign.Rebar.Create.FromCurves(curves=getItemAtIndex_4@L2, rebarStyle=code_block_57.out0@L1, rebarBarType=code_block_57.rebar_bar_type@L1, startHookType=code_block_57.out2@L1, endHookType=code_block_57.out2@L1, startHookOrientation=code_block_57.out1@L1, endHookOrientation=code_block_57.out1@L1, hostElement=filterByBoolMask_3.in@L1, vector=normalAtPoint_3@L1, lacing=Longest)
distanciamiento_barras = CodeBlock(distanciamiento_barras=code_block_40.out2) { distanciamiento_barras; }
code_block_58 = CodeBlock { 350; }
sub = getParameterValueByName - code_block_58
setLayoutAsMaximumSpacing = StructuralDesign.Rebar.Layout.SetLayoutAsMaximumSpacing(rebar=fromCurves, spacing=distanciamiento_barras, arrayLength=sub)
hideElements = archilab.Revit.Views.Views.HideElements(view=activeView, elements=setLayoutAsMaximumSpacing)
current_2 = Document.Current()
activeView_2 = Document.ActiveView(document=current_2)
byJoinedCurves_5 = PolyCurve.ByJoinedCurves()  # unwired: curves
intersect_7 = Geometry.Intersect()  # unwired: geometry, other
byLoft_4 = Surface.ByLoft()  # unwired: crossSections
code_block_59 = CodeBlock(malla_horizontal=code_block_39) { malla_horizontal[0]; malla_horizontal[3]; malla_horizontal[4]; }
code_block_60 = CodeBlock(x=code_block_59.out0) { x; }
getCategory_5 = Element.GetCategory(element=code_block_60)
string_from_object_6 = FromObject(obj=getCategory_5)
code_block_61 = CodeBlock { "Walls"; }
eq_5 = string_from_object_6 == code_block_61
filterByBoolMask_5 = List.FilterByBoolMask(list=code_block_60, mask=eq_5)
geometry_7 = Element.Geometry(element=filterByBoolMask_5.in)
flatten_13 = List.Flatten(list=geometry_7)
centroid_2 = Solid.Centroid(solid=flatten_13)
byOriginNormal_2 = Plane.ByOriginNormal(origin=centroid_2)
intersect_8 = Geometry.Intersect(geometry=flatten_13, other=byOriginNormal_2)
flatten_14 = List.Flatten(list=intersect_8)
perimeterCurves_5 = Surface.PerimeterCurves(surface=flatten_14)
code_block_62 = CodeBlock { null; }
replaceEmptyLists_4 = Custom[List.ReplaceEmptyLists](seq=perimeterCurves_5, Replacement=code_block_62)
code_block_63 = CodeBlock(x=replaceEmptyLists_4)  # same code as code_block_44
code_block_64 = CodeBlock { [1,3]; }
getItemAtIndex_5 = List.GetItemAtIndex(list=code_block_63.out1@L2, index=code_block_64)
list_clean_3 = Custom[List Clean](list=getItemAtIndex_5)
code_block_65 = CodeBlock { 1000; }
extendEnd_4 = Curve.ExtendEnd(curve=list_clean_3, distance=code_block_65)
extendStart_4 = Curve.ExtendStart(curve=extendEnd_4, distance=code_block_65)
function_apply_14 = ApplyFunction(func=byLoft_4, arg1=extendStart_4)
byUnion_4 = Solid.ByUnion()  # unwired: solids
geometry_8 = Element.Geometry()  # unwired: element
filterByBoolMask_6 = List.FilterByBoolMask()  # unwired: list, mask
get_joined_elements_2 = Custom[Get Joined Elements](element=filterByBoolMask_5.in@L1)
getCategory_6 = Element.GetCategory()  # unwired: element
function_apply_15 = ApplyFunction(func=getCategory_6, arg1=get_joined_elements_2)
string_from_object_7 = FromObject(obj=function_apply_15)
code_block_66 = CodeBlock { "Walls"; }
eq_6 = string_from_object_7 == code_block_66
function_apply_16 = ApplyFunction(func=filterByBoolMask_6.in, arg1=get_joined_elements_2, arg2=eq_6)
code_block_67 = CodeBlock(x=function_apply_16)  # same code as code_block_21
count_2 = List.Count(list=filterByBoolMask_5.in)
ofRepeatedItem_2 = List.OfRepeatedItem(item=code_block_67.out1, amount=count_2)
addItemToFront_2 = List.AddItemToFront(item=filterByBoolMask_5.in@L1, list=ofRepeatedItem_2@L2)
function_apply_17 = ApplyFunction(func=geometry_8, arg1=addItemToFront_2)
list_clean_4 = Custom[List Clean](list=function_apply_17)
flatten_15 = List.Flatten(list=list_clean_4@L3)
function_apply_18 = ApplyFunction(func=byUnion_4, arg1=flatten_15)
function_apply_19 = ApplyFunction(func=intersect_7, arg1=function_apply_14, arg2=function_apply_18)
code_block_68 = CodeBlock(x=function_apply_19)  # same code as code_block_21
flatten_16 = List.Flatten(list=code_block_68.out1)
normalAtPoint_4 = Surface.NormalAtPoint(surface=flatten_16, point=centroid_2)
code_block_69 = CodeBlock { "Unconnected Height"; }
getParameterValueByName_2 = Element.GetParameterValueByName(element=filterByBoolMask_5.in, parameterName=code_block_69)
code_block_70 = CodeBlock(t2=getParameterValueByName_2) { t1 = t2 / 2; t3 = t1 - 100; t4 = t3 * -1; }
translate_2 = Geometry.Translate(geometry=flatten_16, direction=normalAtPoint_4, distance=code_block_70.t4)
perimeterCurves_6 = Surface.PerimeterCurves(surface=translate_2)
function_apply_20 = ApplyFunction(func=byJoinedCurves_5, arg1=perimeterCurves_6)
code_block_71 = CodeBlock(l=function_apply_20)  # same code as code_block_52
code_block_72 = CodeBlock { -20; }
offset_2 = Curve.Offset(curve=code_block_71.out1, distance=code_block_72)
byJoinedCurves_6 = PolyCurve.ByJoinedCurves(curves=offset_2@L1)
curves_4 = PolyCurve.Curves(polyCurve=byJoinedCurves_6)
code_block_73 = CodeBlock { null; }
replaceEmptyLists_5 = Custom[List.ReplaceEmptyLists](seq=curves_4, Replacement=code_block_73)
code_block_74 = CodeBlock(x=replaceEmptyLists_5)  # same code as code_block_44
code_block_75 = CodeBlock { [0,1]; }
getItemAtIndex_6 = List.GetItemAtIndex(list=code_block_74.out1@L2, index=code_block_75)
code_block_76 = CodeBlock(rebar_bar_type=code_block_59.out1)  # same code as code_block_57
fromCurves_2 = StructuralDesign.Rebar.Create.FromCurves(curves=getItemAtIndex_6@L2, rebarStyle=code_block_76.out0@L1, rebarBarType=code_block_76.rebar_bar_type@L1, startHookType=code_block_76.out2@L1, endHookType=code_block_76.out2@L1, startHookOrientation=code_block_76.out1@L1, endHookOrientation=code_block_76.out1@L1, hostElement=filterByBoolMask_5.in@L1, vector=normalAtPoint_4@L1, lacing=Longest)
distanciamiento_barras_2 = CodeBlock(distanciamiento_barras=code_block_59.out2) { distanciamiento_barras; }
code_block_77 = CodeBlock { 350; }
sub_2 = getParameterValueByName_2 - code_block_77
setLayoutAsMaximumSpacing_2 = StructuralDesign.Rebar.Layout.SetLayoutAsMaximumSpacing(rebar=fromCurves_2, spacing=distanciamiento_barras_2, arrayLength=sub_2)
hideElements_2 = archilab.Revit.Views.Views.HideElements(view=activeView_2, elements=setLayoutAsMaximumSpacing_2)
current_3 = Document.Current()
activeView_3 = Document.ActiveView(document=current_3)
byJoinedCurves_7 = PolyCurve.ByJoinedCurves()  # unwired: curves
byJoinedCurves_8 = PolyCurve.ByJoinedCurves()  # unwired: curves
byJoinedCurves_9 = PolyCurve.ByJoinedCurves()  # unwired: curves
code_block_78 = CodeBlock(x=code_block_24) { x; }
code_block_79 = CodeBlock { "Length"; }
getParameterValueByName_3 = Element.GetParameterValueByName(element=code_block_78, parameterName=code_block_79)
round = Math.Round(number=getParameterValueByName_3)
rebarDiameter_2 = StructuralDesign.Rebar.Properties.RebarDiameter(rebar=code_block_23.out1)
code_block_80 = CodeBlock(t2=round, barDiameter=rebarDiameter_2) { t1 = t2 / 2; t3 = t1 - 200; t4 = t3 * -1 + barDiameter; }
translate_3 = Geometry.Translate(geometry=flatten_8, direction=normalAtPoint_2, distance=code_block_80.t4)
perimeterCurves_7 = Surface.PerimeterCurves(surface=translate_3)
function_apply_21 = ApplyFunction(func=byJoinedCurves_9, arg1=perimeterCurves_7)
code_block_81 = CodeBlock(x=function_apply_21)  # same code as code_block_21
code_block_82 = CodeBlock { -20; false; }
offset_3 = PolyCurve.Offset(polyCurve=code_block_81.out1, signedDistance=code_block_82.out0, extendCircular=code_block_82.out1)
function_apply_22 = ApplyFunction(func=byJoinedCurves_8, arg1=offset_3)
code_block_83 = CodeBlock(x=function_apply_22)  # same code as code_block_21
curves_5 = PolyCurve.Curves(polyCurve=code_block_83.out1)
code_block_84 = CodeBlock { null; }
replaceEmptyLists_6 = Custom[List.ReplaceEmptyLists](seq=curves_5, Replacement=code_block_84)
code_block_85 = CodeBlock(x=replaceEmptyLists_6)
# ---------- code_block_85.designscript (13 lines) ----------
x;

[Imperative]
{
	if (x == null)
	{
		return = [null,null];
	}
	else
	{
		return = x;
	}
};
# ----------------------------------------
code_block_86 = CodeBlock { [2,3]; }
getItemAtIndex_7 = List.GetItemAtIndex(list=code_block_85.out1@L2, index=code_block_86)
code_block_87 = CodeBlock(l=getItemAtIndex_7)  # same code as code_block_32
code_block_88 = CodeBlock(t1=code_block_87.out1)
# ---------- code_block_88.designscript (6 lines) ----------
point1 = Autodesk.Curve.StartPoint(t1);
point2 = Autodesk.Curve.EndPoint(t1);
vector1 = Autodesk.Vector.ByTwoPoints(point1, point2);
num2 = Autodesk.Vector.Z(vector1);
t2 = num2 < 0;
curve1 = Autodesk.Curve.Reverse(t1);
# ----------------------------------------
if_ = If(test=code_block_88.t2, true=code_block_88.curve1, false=code_block_87.out1)
code_block_89 = CodeBlock { 1; }
shiftIndices = List.ShiftIndices(list=if_@L2, amount=code_block_89)
code_block_90 = CodeBlock { 0; }
code_block_91 = CodeBlock { -30; }
extendStart_5 = Curve.ExtendStart(curve=shiftIndices@L1, distance=code_block_91, lacing=Shortest)
replaceItemAtIndex = List.ReplaceItemAtIndex(list=shiftIndices@L2, index=code_block_90@L1, item=extendStart_5@L1)
function_apply_23 = ApplyFunction(func=byJoinedCurves_7, arg1=replaceItemAtIndex)
code_block_92 = CodeBlock(x=function_apply_23)  # same code as code_block_21
curves_6 = PolyCurve.Curves(polyCurve=code_block_92.out1)
code_block_93 = CodeBlock(rebar_bar_type=code_block_23.out1)
# ---------- code_block_93.designscript (8 lines) ----------
//RebaarStyle
"Standard";
//RebarHookOrientation
"Left";
//Rebar Hook Type;
null;
//RebarBarType
rebar_bar_type;
# ----------------------------------------
element_types_ᶜᵒⁿᵛᵉʳᵗᵉᵈ_ᵈʳᵒᵖᵈᵒʷⁿ_3 = CodeBlock { DSCore.Types.FindTypeByNameInAssembly("RebarHookType", "RevitAPI"); }
all_elements_of_type_3 = ElementsOfType(element_type=element_types_ᶜᵒⁿᵛᵉʳᵗᵉᵈ_ᵈʳᵒᵖᵈᵒʷⁿ_3)
rebar_hook_type_at_start = CodeBlock(t3=all_elements_of_type_3)
# ---------- rebar_hook_type_at_start.designscript (5 lines) ----------
t1 = t3;
str2 = Revit.Elements.Element.Name(t1);
t2 = str2 == "Standard - 90 deg.";
t4 = DSCore.List.FilterByBoolMask(t3, t2);
t5 = Dictionary.ValueAtKey(t4, "in");
# ----------------------------------------
rebar_hook_type_at_end = CodeBlock(t3=all_elements_of_type_3)
# ---------- rebar_hook_type_at_end.designscript (5 lines) ----------
t1 = t3;
str2 = Revit.Elements.Element.Name(t1);
t2 = str2 == "Malla - 135 deg.";
t4 = DSCore.List.FilterByBoolMask(t3, t2);
t5 = Dictionary.ValueAtKey(t4, "in");
# ----------------------------------------
fromCurves_3 = StructuralDesign.Rebar.Create.FromCurves(curves=curves_6@L2, rebarStyle=code_block_93.out0@L1, rebarBarType=code_block_93.rebar_bar_type@L1, startHookType=rebar_hook_type_at_start.t5@L1, endHookType=rebar_hook_type_at_end.t5@L1, startHookOrientation=code_block_93.out1@L1, endHookOrientation=code_block_93.out1@L1, hostElement=filterByBoolMask_2.in@L1, vector=normalAtPoint_2@L1, lacing=Longest)
distanciamiento_barras_3 = CodeBlock(distanciamiento_barras=code_block_23.out2) { distanciamiento_barras; }
code_block_94 = CodeBlock { 400; }
sub_3 = round - code_block_94
setLayoutAsMaximumSpacing_3 = StructuralDesign.Rebar.Layout.SetLayoutAsMaximumSpacing(rebar=fromCurves_3, spacing=distanciamiento_barras_3, arrayLength=sub_3)
hideElements_3 = archilab.Revit.Views.Views.HideElements(view=activeView_3, elements=setLayoutAsMaximumSpacing_3)
current_4 = Document.Current()
activeView_4 = Document.ActiveView(document=current_4)
byJoinedCurves_10 = PolyCurve.ByJoinedCurves()  # unwired: curves
byJoinedCurves_11 = PolyCurve.ByJoinedCurves()  # unwired: curves
code_block_95 = CodeBlock(x=code_block_14) { x; }
code_block_96 = CodeBlock { "Length"; }
getParameterValueByName_4 = Element.GetParameterValueByName(element=code_block_95, parameterName=code_block_96)
round_2 = Math.Round(number=getParameterValueByName_4)
code_block_97 = CodeBlock(t2=round_2) { t1 = t2 / 2; t3 = t1 - 200; t4 = t3 * -1; }
translate_4 = Geometry.Translate(geometry=flatten_4, direction=normalAtPoint, distance=code_block_97.t4)
perimeterCurves_8 = Surface.PerimeterCurves(surface=translate_4)
function_apply_24 = ApplyFunction(func=byJoinedCurves_11, arg1=perimeterCurves_8)
code_block_98 = CodeBlock { -20; false; }
offset_4 = PolyCurve.Offset(polyCurve=function_apply_24, signedDistance=code_block_98.out0, extendCircular=code_block_98.out1)
function_apply_25 = ApplyFunction(func=byJoinedCurves_10, arg1=offset_4)
curves_7 = PolyCurve.Curves(polyCurve=function_apply_25)
code_block_99 = CodeBlock { [1,2]; }
getItemAtIndex_8 = List.GetItemAtIndex(list=curves_7@L2, index=code_block_99)
code_block_100 = CodeBlock(t1=getItemAtIndex_8)  # same code as code_block_88
if_2 = If(test=code_block_100.t2, true=code_block_100.curve1, false=getItemAtIndex_8)
code_block_101 = CodeBlock { 0; }
code_block_102 = CodeBlock { -30; }
extendStart_6 = Curve.ExtendStart(curve=if_2@L1, distance=code_block_102, lacing=Shortest)
replaceItemAtIndex_2 = List.ReplaceItemAtIndex(list=if_2@L2, index=code_block_101@L1, item=extendStart_6@L1)
code_block_103 = CodeBlock(rebar_bar_type=code_block_13.out1)
# ---------- code_block_103.designscript (8 lines) ----------
//RebaarStyle
"Standard";
//RebarHookOrientation
"Right";
//Rebar Hook Type;
null;
//RebarBarType
rebar_bar_type;
# ----------------------------------------
element_types_ᶜᵒⁿᵛᵉʳᵗᵉᵈ_ᵈʳᵒᵖᵈᵒʷⁿ_4 = CodeBlock { DSCore.Types.FindTypeByNameInAssembly("RebarHookType", "RevitAPI"); }
all_elements_of_type_4 = ElementsOfType(element_type=element_types_ᶜᵒⁿᵛᵉʳᵗᵉᵈ_ᵈʳᵒᵖᵈᵒʷⁿ_4)
rebar_hook_type_at_start_2 = CodeBlock(t3=all_elements_of_type_4)  # same code as rebar_hook_type_at_start
rebar_hook_type_at_end_2 = CodeBlock(t3=all_elements_of_type_4)
# ---------- rebar_hook_type_at_end_2.designscript (5 lines) ----------
t1 = t3;
str2 = Revit.Elements.Element.Name(t1);
t2 = str2 == "Standard - 135 deg.";
t4 = DSCore.List.FilterByBoolMask(t3, t2);
t5 = Dictionary.ValueAtKey(t4, "in");
# ----------------------------------------
fromCurves_4 = StructuralDesign.Rebar.Create.FromCurves(curves=replaceItemAtIndex_2@L2, rebarStyle=code_block_103.out0@L1, rebarBarType=code_block_103.rebar_bar_type@L1, startHookType=rebar_hook_type_at_start_2.t5@L1, endHookType=rebar_hook_type_at_end_2.t5@L1, startHookOrientation=code_block_103.out1@L1, endHookOrientation=code_block_103.out1@L1, hostElement=filterByBoolMask.in@L1, vector=normalAtPoint@L1, lacing=Longest)
distanciamiento_barras_4 = CodeBlock(distanciamiento_barras=code_block_13.out2) { distanciamiento_barras; }
code_block_104 = CodeBlock { 400; }
sub_4 = round_2 - code_block_104
setLayoutAsMaximumSpacing_4 = StructuralDesign.Rebar.Layout.SetLayoutAsMaximumSpacing(rebar=fromCurves_4, spacing=distanciamiento_barras_4, arrayLength=sub_4)
hideElements_4 = archilab.Revit.Views.Views.HideElements(view=activeView_4, elements=setLayoutAsMaximumSpacing_4)
